# Dynamo graph 00_ЛИСТ_СоздатьНабор.dyn "02_ЛИСТ_СоздатьНабор" (Dynamo 2.0.2.6826)

# note: Инструкция:
# Выбрать в диспетчере проекта листы/виды для добавления в набор. Указать имя набора в ноде "Имя набора". Запустить скрипт.
# В результате работы листа создастся набор листов с задаными видами. Если такое имя набора листов уже существует, то будет добавлен суффикс "copy#", где # - номер копии.
# Для перезапуска скрипта - следует либо изменить имя набора, либо переключить переключатель Reset
reset = BoolSelector(true)  # graph input
имя_набора = StringInput("BimTeam")  # graph input
python_script = Python(IN[0]=reset, IN[1]=имя_набора)
# ---------- python_script.python (76 lines) ----------
import clr

clr.AddReference('ProtoGeometry')
from Autodesk.DesignScript.Geometry import *

clr.AddReference("RevitServices")
import RevitServices
from RevitServices.Persistence import DocumentManager
from RevitServices.Transactions import TransactionManager
from System.Collections.Generic import *

# Import RevitAPI
clr.AddReference("RevitAPI")
import Autodesk
from Autodesk.Revit.DB import *

clr.AddReference("RevitAPIUI")
from Autodesk.Revit.UI import *

doc = DocumentManager.Instance.CurrentDBDocument
uiapp = DocumentManager.Instance.CurrentUIApplication
app = uiapp.Application
uidoc = DocumentManager.Instance.CurrentUIApplication.ActiveUIDocument
name = IN[1]

def save_vss(vss,  name):
    if "_copy" in name:
        revision = int(name.split("_copy")[-1])
    else:
        revision = 0
    try:
        vss.SaveAs(name)
        if revision != 0:
            TaskDialog.Show("Ошибка имени", "Имя набора уже существует. Будет задано имя <%s> "%name)
        else:
            TaskDialog.Show("Успешное выполнение", "Создано набор видов с именем <%s>"%name)
    except Exception:
        if revision == 0:
            revision += 1
            newname = name + "_copy" + str(revision)
            save_vss(vss, newname)
        else:
            revision += 1
            newname = name.split("_copy")[0] + "_copy" + str(revision)
            save_vss(vss, newname)

Ids = uidoc.Selection.GetElementIds()
elems = []
for i in Ids:
    elems.append(doc.GetElement(i))


pm = doc.PrintManager
if pm.PrintRange != PrintRange.Select:
    pm.PrintRange = PrintRange.Select

vss = pm.ViewSheetSetting
viewSet = ViewSet()

for sh in elems:
    if sh.CanBePrinted:
        viewSet.Insert(sh)

vss.CurrentViewSheetSet.Views = viewSet
#view_sheet_settingS = FilteredElementCollector(doc).OfClass(ViewSheet)

err = []

TransactionManager.Instance.EnsureInTransaction(doc)

save_vss(vss, name)

TransactionManager.Instance.TransactionTaskDone()


OUT = "done"
# ----------------------------------------
