# Dynamo graph 01_ЛИСТ_Заполнитель.dyn (Dynamo 2.0.2.6826)

# group: Входные данные. Выбираем листы
categories = Categories(index=233)
start = Revit.Transaction.Transaction.Start(input=categories)
all_elements_of_category = ElementsOfCategory(Category=start)
sheetNumber = Sheet.SheetNumber(sheet=all_elements_of_category)
разделитель = StringInput("_")  # graph input
split = String.Split(str=sheetNumber, separater0=разделитель)

# group: Группа 1. Управляет параметром “ЛИСТ_Раздел проекта”, присваивая ему значение исходя из первых символов имени нашего листа до знака "_" .
integer_slider = IntegerSlider(0, range=0..10 step 1)  # frozen
getItemAtIndex = List.GetItemAtIndex(list=split, index=integer_slider, lacing=Longest)
code_block = CodeBlock { "ЛИСТ_Раздел проекта"; }  # frozen
setParameterByName = Element.SetParameterByName(element=all_elements_of_category, parameterName=code_block)  # frozen; unwired: value

# group: Группа 2. Управляет параметром “ЛИСТ_Номер листа”, присваивая ему значение, исходя из последних символов после знака "_" .
code_block_2 = CodeBlock { "ЛИСТ_Номер листа"; }
lastItem = List.LastItem(list=split@L2)
setParameterByName_2 = Element.SetParameterByName(element=all_elements_of_category, parameterName=code_block_2, value=lastItem)

# group: Открываем и закрываем транзакцию
end = Revit.Transaction.Transaction.End(input=setParameterByName_2)
start_2 = Revit.Transaction.Transaction.Start(input=end)

# group: Выбираем все виды на листах. Делим номер листа на состовляющие
ꟿ_sheet_views = Custom[ꟿ Sheet.Views+](sheet=start_2)  # Extracts all views and schedules (minus the revision schedule) placed on the input sheet (or sheets). Will be depreciated once the bult in node works with all plan types.
code_block_3 = CodeBlock { "Ссылающийся лист"; }
parameterByName = Parameter.ParameterByName(element=ꟿ_sheet_views.view_s, name=code_block_3)
string_from_object = FromObject(obj=parameterByName)
разделитель_2 = StringInput("_")  # graph input
split_2 = String.Split(str=string_from_object@L1, separater0=разделитель_2)
lastItem_2 = List.LastItem(list=split_2@L2)
разделитель_3 = StringInput(": ")  # graph input
split_3 = String.Split(str=lastItem_2@L1, separater0=разделитель_3)
lastItem_3 = List.LastItem(list=split_3@L2)

# group: Группа 3. Управляет параметром “ЛИСТ_Номер листа”, присваивая виду значение, исходя из последних символов после знака "_" .
code_block_4 = CodeBlock { "ЛИСТ_Номер листа"; }
setParameterByName_3 = Element.SetParameterByName(element=ꟿ_sheet_views.view_s@L1, parameterName=code_block_4, value=lastItem_3@L1)
