# Dynamo graph 1.33_Создать рабочие наборы из EXCEL.dyn (Dynamo 2.0.2.6826)

file_path = Filename(".\Worksets.xlsx")  # graph input
fromPath = FileObject(path=file_path)  # "File.FromPath"
string = StringInput("ВК")  # graph input
boolean = BoolSelector(false)  # graph input
importExcel = Data.ImportExcel(file=fromPath, sheetName=string, readAsStrings=boolean)
flatten = List.Flatten(list=importExcel)
create = Custom[Workset.Create](worksetNames=flatten)  # Creates a workset or worksets from input names.
