# Dynamo graph 1.35_ADSK_Этаж.dyn (Dynamo 1.3.1.1736)

all_elements_in_active_view = ElementsInView()
code_block = CodeBlock { "ADSK_Этаж"; }
level = Custom[Element.Level](element=all_elements_in_active_view)  # Gets an element's level
name = Level.Name(level)
setParameterByName = Element.SetParameterByName(element=all_elements_in_active_view, parameterName=code_block, value=name)
