# Dynamo graph 1.36_Связь_DWG.dyn (Dynamo 1.3.2.2480)

# group: Выбираем папку с файлами
dwg_directory_path = Directory("C:\Users\kakoulin.ae\Downloads\DWG")

# group: Фильтруем DWG
fromPath = DirectoryObject(dwg_directory_path)  # "Directory.FromPath"
string = StringInput("*.dwg")
contents = Directory.Contents(fromPath, string)
watch = Watch(contents)

# group: Берем имена DWG для названия видов
code_block = CodeBlock { false; }
fileName = FilePath.FileName(watch, code_block)
dwgs_to_be_linked = Watch(fileName)
byName = DraftingView.ByName(fileName)

code_block_2 = CodeBlock()
# ---------- code_block_2.designscript (53 lines) ----------
"# Link DWGs
import clr
clr.AddReference('ProtoGeometry')
from Autodesk.DesignScript.Geometry import *
# 5
# Import DocumentManager and TransactionManager
clr.AddReference('RevitServices')
import RevitServices
from RevitServices.Persistence import DocumentManager
from RevitServices.Transactions import TransactionManager
#11
doc = DocumentManager.Instance.CurrentDBDocument
uiapp = DocumentManager.Instance.CurrentUIApplication
app = uiapp.Application
#15
# Import RevitAPI
clr.AddReference('RevitAPI')
import Autodesk
from Autodesk.Revit.DB import *
#20
#The inputs to this node will be stored as a list in the IN variables.
dataEnteringNode = IN

filePaths = IN[0]
views = UnwrapElement(IN[1])
viewsplaced=list()
#27
options = DWGImportOptions()
options.AutoCorrectAlmostVHLines = True
# ВКЛ/ВЫКЛ ЧБ ЦВЕТА
#options.ColorMode = ImportColorMode.BlackAndWhite
options.OrientToView = True
options.ThisViewOnly = True
options.VisibleLayersOnly = True
options.CustomScale = 100
options.Unit = ImportUnit.Default
options.Placement= ImportPlacement.Centered
options.Unit = ImportUnit.Default
options.Placement= ImportPlacement.Centered
#options.Placement = Origin
#38
LinkedElem = clr.Reference[ElementId]()

for view in range(len(views)):
 TransactionManager.Instance.EnsureInTransaction(doc)
 doc.Link(filePaths[view], options, views[view])
 TransactionManager.Instance.TransactionTaskDone()
 viewsplaced.append(views[view])
#46

#Assign your output to the OUT variable.
OUT = viewsplaced;
";
# ----------------------------------------
python_script_from_string = PythonStringNode(script=code_block_2, IN[0]=watch, IN[1]=byName)
