# Dynamo graph 1.37_Копировать_Параметр_Экземпляра.dyn (Dynamo 1.3.4.6666)

categories = Categories("GenericModel")
all_elements_of_category = ElementsOfCategory(categories)
code_block = CodeBlock { "ИНЖ_Отв_Номер"; }
code_block_2 = CodeBlock { "Марка"; }
getParameterValueByName = Element.GetParameterValueByName(element=all_elements_of_category, parameterName=code_block_2)
toNumber = String.ToNumber(getParameterValueByName)
setParameterByName = Element.SetParameterByName(element=all_elements_of_category, parameterName=code_block, value=toNumber)
