# Dynamo graph 3.1.1_СП_Трубопровод.dyn (Dynamo 1.3.2.2480)

# group: Выбор всех поздуховодов в проекте
categories = Categories("PipeCurves")
all_elements_of_category = ElementsOfCategory(categories)

# group: Хочу менять
фильтр_по_экземпляру = StringInput("н/у в СП")

# group: Фильтрация выборки воздуховодов по значения параметра "ПР_Для фильтрации по экземпляру"
code_block = CodeBlock { "ПР_Для фильтрации по экземпляру"; }
getParameterValueByName = Element.GetParameterValueByName(element=all_elements_of_category, parameterName=code_block)
contains = String.Contains(str=getParameterValueByName, searchFor=фильтр_по_экземпляру)
filterByBoolMask = List.FilterByBoolMask(list=all_elements_of_category, mask=contains)

# group: Хочу менять
фильтр_по_типу = StringInput("н/у в СП")

# group: Фильтрация выборки воздуховодов по значения параметра "ПР_Для фильтрации по типу"
code_block_2 = CodeBlock { "ПР_Для фильтрации по типу"; }
get_type_parameter = Custom[Get Type Parameter](element=filterByBoolMask.out, parameterName=code_block_2)  # This node will retrieve a type parameter by its name.
code_block_3 = CodeBlock { " "; }
replaceNulls = Lists.Manage.ReplaceNulls(get_type_parameter, code_block_3)
contains_2 = String.Contains(str=replaceNulls, searchFor=фильтр_по_типу)
filterByBoolMask_2 = List.FilterByBoolMask(list=filterByBoolMask.out, mask=contains_2)

# group: Хочу менять
запас = DoubleInput(1.1)

# group: Переброс параметра длмна в параметр СП_Количество
code_block_4 = CodeBlock { "ADSK_Количество"; }
code_block_5 = CodeBlock { "Длина"; }
getParameterValueByName_2 = Element.GetParameterValueByName(element=filterByBoolMask_2.out, parameterName=code_block_5)
code_block_6 = CodeBlock(a=getParameterValueByName_2, b=запас) { a*b/1000; }
setParameterByName = Element.SetParameterByName(element=filterByBoolMask_2.out, parameterName=code_block_4, value=code_block_6)

# group: Высчитываем массу и добавляем в СП_Масса
code_block_7 = CodeBlock { "ADSK_Масса"; }
code_block_8 = CodeBlock { "Площадь"; }
getParameterValueByName_3 = Element.GetParameterValueByName(element=filterByBoolMask_2.out, parameterName=code_block_8)  # frozen
code_block_9 = CodeBlock { "Внешний диаметр"; }
getParameterValueByName_4 = Element.GetParameterValueByName(element=filterByBoolMask_2.out, parameterName=code_block_9)  # frozen
code_block_10 = CodeBlock { "Внутренний диаметр"; }
getParameterValueByName_5 = Element.GetParameterValueByName(element=filterByBoolMask_2.out, parameterName=code_block_10)  # frozen
code_block_11 = CodeBlock(a=getParameterValueByName_3, b=запас, c=getParameterValueByName_4, e=getParameterValueByName_5) { 7.85*a*b*(c-e)/2; }
setParameterByName_2 = Element.SetParameterByName(element=filterByBoolMask_2.out, parameterName=code_block_7, value=code_block_11)

# group: Фильтрация выборки воздуховодов по значения параметра "Тип трубопровода"
code_block_12 = CodeBlock { "Тип трубопровода"; }
getParameterValueByNameTypeOrInstance = Rhythm.Revit.Elements.Element.GetParameterValueByNameTypeOrInstance(filterByBoolMask_2.out, code_block_12)
toString = Custom[Number.ToString](num=getParameterValueByNameTypeOrInstance)  # Converts the input number(s) to string. Can process lists.
number = DoubleInput(4.1)
toString_2 = Custom[Number.ToString](num=number)
contains_3 = String.Contains(str=toString, searchFor=toString_2)
filterByBoolMask_3 = List.FilterByBoolMask(list=filterByBoolMask_2.out, mask=contains_3)

# group: Списки_Труба стальная
code_block_13 = CodeBlock()
# ---------- code_block_13.designscript (18 lines) ----------
"Труба стальная водогазопроводная ø15х2.8";
"Труба стальная водогазопроводная ø20х2.8";
"Труба стальная водогазопроводная ø25х3.2";
"Труба стальная водогазопроводная ø32х3.2";
"Труба стальная водогазопроводная ø40х3.5";
"Труба стальная электросварная ø57х3.5";
"Труба стальная электросварная ø76х3.5";
"Труба стальная электросварная ø89х3.5";
"Труба стальная электросварная ø108х4.0";
"Труба стальная электросварная ø133х4.0";
"Труба стальная электросварная ø159х4.5";
"Труба стальная электросварная ø219х6.0";
"Труба стальная электросварная ø273х7.0";
"Труба стальная электросварная ø325х7.0";
"Труба стальная электросварная ø377х7.0";
"Труба стальная электросварная ø426х7.0";
"Труба стальная электросварная ø478х7.0";
"Труба стальная электросварная ø529х7.0";
# ----------------------------------------
create = List.Create(code_block_13.out0, code_block_13.out1, code_block_13.out2, code_block_13.out3, code_block_13.out4, code_block_13.out5, code_block_13.out6, code_block_13.out7, code_block_13.out8, code_block_13.out9, code_block_13.out10, code_block_13.out11, code_block_13.out12, code_block_13.out13, code_block_13.out14, code_block_13.out15, code_block_13.out16, code_block_13.out17)
code_block_14 = CodeBlock { 15; 20; 25; 32; 40; 50; 65; 80; 100; 125; 150; 200; 250; 300; 350; 400; 450; 500; }
create_2 = List.Create(code_block_14.out0, code_block_14.out1, code_block_14.out2, code_block_14.out3, code_block_14.out4, code_block_14.out5, code_block_14.out6, code_block_14.out7, code_block_14.out8, code_block_14.out9, code_block_14.out10, code_block_14.out11, code_block_14.out12, code_block_14.out13, code_block_14.out14, code_block_14.out15, code_block_14.out16, code_block_14.out17)

# group: Выбор параметра "диаметр" воздуховодов и конвертация величины в миллиметны
code_block_15 = CodeBlock { "Диаметр"; }
getParameterValueByName_6 = Element.GetParameterValueByName(element=filterByBoolMask_3.in, parameterName=code_block_15)
convert_between_units = DynamoConvert(getParameterValueByName_6, conversionMetric=Length, conversionFrom=Feet, conversionTo=Millimeters)

# group: Преобразование параметра "диаметр" в текстовый параметр
string_from_object = FromObject(convert_between_units)
code_block_16 = CodeBlock { ","; }
split = String.Split(string_from_object, code_block_16)
transpose = List.Transpose(split)
code_block_17 = CodeBlock(p=transpose) { p[0]; }

# group: Сравнение списков
toNumber = String.ToNumber(code_block_17)
firstIndexOf = List.FirstIndexOf(list=create_2, item=toNumber)
getItemAtIndex = List.GetItemAtIndex(list=create, index=firstIndexOf)

# group: Сборка текста
code_block_18 = CodeBlock { "ADSK_Наименование"; }
setParameterByName_3 = Element.SetParameterByName(element=filterByBoolMask_3.in, parameterName=code_block_18, value=getItemAtIndex)

# group: Фильтрация выборки воздуховодов по значения параметра "Тип трубопровода"
code_block_19 = CodeBlock { "Тип трубопровода"; }
getParameterValueByNameTypeOrInstance_2 = Rhythm.Revit.Elements.Element.GetParameterValueByNameTypeOrInstance(filterByBoolMask_2.out, code_block_19)
toString_3 = Custom[Number.ToString](num=getParameterValueByNameTypeOrInstance_2)
number_2 = DoubleInput(1.1)
toString_4 = Custom[Number.ToString](num=number_2)
contains_4 = String.Contains(str=toString_3, searchFor=toString_4)
filterByBoolMask_4 = List.FilterByBoolMask(list=filterByBoolMask_2.out, mask=contains_4)

# group: Списки_
code_block_20 = CodeBlock()
# ---------- code_block_20.designscript (11 lines) ----------
"Труба полипропиленовая ø20";
"Труба полипропиленовая ø25";
"Труба полипропиленовая ø32";
"Труба полипропиленовая ø40";
"Труба полипропиленовая ø50";
"Труба полипропиленовая ø63";
"Труба полипропиленовая ø75";
"Труба полипропиленовая ø90";
"Труба полипропиленовая ø110";
"Труба полипропиленовая ø125";
"Труба полипропиленовая ø160";
# ----------------------------------------
create_3 = List.Create(code_block_20.out0, code_block_20.out1, code_block_20.out2, code_block_20.out3, code_block_20.out4, code_block_20.out5, code_block_20.out6, code_block_20.out7, code_block_20.out8, code_block_20.out9, code_block_20.out10)
code_block_21 = CodeBlock { 20; 25; 32; 40; 50; 63; 75; 90; 110; 125; 160; }
create_4 = List.Create(code_block_21.out0, code_block_21.out1, code_block_21.out2, code_block_21.out3, code_block_21.out4, code_block_21.out5, code_block_21.out6, code_block_21.out7, code_block_21.out8, code_block_21.out9, code_block_21.out10)

# group: Выбор параметра "диаметр" воздуховодов и конвертация величины в миллиметны
code_block_22 = CodeBlock { "Диаметр"; }
getParameterValueByName_7 = Element.GetParameterValueByName(element=filterByBoolMask_4.in, parameterName=code_block_22)
convert_between_units_2 = DynamoConvert(getParameterValueByName_7, conversionMetric=Length, conversionFrom=Feet, conversionTo=Millimeters)

# group: Преобразование параметра "диаметр" в текстовый параметр
string_from_object_2 = FromObject(convert_between_units_2)
code_block_23 = CodeBlock { ","; }
split_2 = String.Split(string_from_object_2, code_block_23)
transpose_2 = List.Transpose(split_2)
code_block_24 = CodeBlock(p=transpose_2) { p[0]; }

# group: Сравнение списков
toNumber_2 = String.ToNumber(code_block_24)
firstIndexOf_2 = List.FirstIndexOf(list=create_4, item=toNumber_2)
getItemAtIndex_2 = List.GetItemAtIndex(list=create_3, index=firstIndexOf_2)

# group: Сборка текста
code_block_25 = CodeBlock { "ADSK_Наименование"; }
setParameterByName_4 = Element.SetParameterByName(element=filterByBoolMask_4.in, parameterName=code_block_25, value=getItemAtIndex_2)

# group: Фильтрация выборки воздуховодов по значения параметра "Тип трубопровода"
code_block_26 = CodeBlock { "Тип трубопровода"; }
getParameterValueByNameTypeOrInstance_3 = Rhythm.Revit.Elements.Element.GetParameterValueByNameTypeOrInstance(filterByBoolMask_2.out, code_block_26)
toString_5 = Custom[Number.ToString](num=getParameterValueByNameTypeOrInstance_3)
number_3 = DoubleInput(1.2)
toString_6 = Custom[Number.ToString](num=number_3)
contains_5 = String.Contains(str=toString_5, searchFor=toString_6)
filterByBoolMask_5 = List.FilterByBoolMask(list=filterByBoolMask_2.out, mask=contains_5)

# group: Списки_
code_block_27 = CodeBlock()
# ---------- code_block_27.designscript (11 lines) ----------
"Труба полипропиленовая композитная ø20";
"Труба полипропиленовая композитная ø25";
"Труба полипропиленовая композитная ø32";
"Труба полипропиленовая композитная ø40";
"Труба полипропиленовая композитная ø50";
"Труба полипропиленовая композитная ø63";
"Труба полипропиленовая композитная ø75";
"Труба полипропиленовая композитная ø90";
"Труба полипропиленовая композитная ø110";
"Труба полипропиленовая композитная ø125";
"Труба полипропиленовая композитная ø160";
# ----------------------------------------
create_5 = List.Create(code_block_27.out0, code_block_27.out1, code_block_27.out2, code_block_27.out3, code_block_27.out4, code_block_27.out5, code_block_27.out6, code_block_27.out7, code_block_27.out8, code_block_27.out9, code_block_27.out10)
code_block_28 = CodeBlock { 20; 25; 32; 40; 50; 63; 75; 90; 110; 125; 160; }
create_6 = List.Create(code_block_28.out0, code_block_28.out1, code_block_28.out2, code_block_28.out3, code_block_28.out4, code_block_28.out5, code_block_28.out6, code_block_28.out7, code_block_28.out8, code_block_28.out9, code_block_28.out10)

# group: Выбор параметра "диаметр" воздуховодов и конвертация величины в миллиметны
code_block_29 = CodeBlock { "Диаметр"; }
getParameterValueByName_8 = Element.GetParameterValueByName(element=filterByBoolMask_5.in, parameterName=code_block_29)
convert_between_units_3 = DynamoConvert(getParameterValueByName_8, conversionMetric=Length, conversionFrom=Feet, conversionTo=Millimeters)

# group: Преобразование параметра "диаметр" в текстовый параметр
string_from_object_3 = FromObject(convert_between_units_3)
code_block_30 = CodeBlock { ","; }
split_3 = String.Split(string_from_object_3, code_block_30)
transpose_3 = List.Transpose(split_3)
code_block_31 = CodeBlock(p=transpose_3) { p[0]; }

# group: Сравнение списков
toNumber_3 = String.ToNumber(code_block_31)
firstIndexOf_3 = List.FirstIndexOf(list=create_6, item=toNumber_3)
getItemAtIndex_3 = List.GetItemAtIndex(list=create_5, index=firstIndexOf_3)

# group: Сборка текста
code_block_32 = CodeBlock { "ADSK_Наименование"; }
setParameterByName_5 = Element.SetParameterByName(element=filterByBoolMask_5.in, parameterName=code_block_32, value=getItemAtIndex_3)

# group: Фильтрация выборки воздуховодов по значения параметра "Тип трубопровода"
code_block_33 = CodeBlock { "Тип трубопровода"; }
getParameterValueByNameTypeOrInstance_4 = Rhythm.Revit.Elements.Element.GetParameterValueByNameTypeOrInstance(filterByBoolMask_2.out, code_block_33)
toString_7 = Custom[Number.ToString](num=getParameterValueByNameTypeOrInstance_4)
number_4 = DoubleInput(2.1)
toString_8 = Custom[Number.ToString](num=number_4)
contains_6 = String.Contains(str=toString_7, searchFor=toString_8)
filterByBoolMask_6 = List.FilterByBoolMask(list=filterByBoolMask_2.out, mask=contains_6)

# group: Списки_
code_block_34 = CodeBlock()
# ---------- code_block_34.designscript (5 lines) ----------
"Труба полипропиленовая композитная ø32";
"Труба полипропиленовая композитная ø40";
"Труба полипропиленовая композитная ø50";
"Труба полипропиленовая композитная ø110";
"Труба полипропиленовая композитная ø160";
# ----------------------------------------
create_7 = List.Create(code_block_34.out0, code_block_34.out1, code_block_34.out2, code_block_34.out3, code_block_34.out4)
code_block_35 = CodeBlock { 32; 40; 50; 110; 160; }
create_8 = List.Create(code_block_35.out0, code_block_35.out1, code_block_35.out2, code_block_35.out3, code_block_35.out4)

# group: Выбор параметра "диаметр" воздуховодов и конвертация величины в миллиметны
code_block_36 = CodeBlock { "Диаметр"; }
getParameterValueByName_9 = Element.GetParameterValueByName(element=filterByBoolMask_6.in, parameterName=code_block_36)
convert_between_units_4 = DynamoConvert(getParameterValueByName_9, conversionMetric=Length, conversionFrom=Feet, conversionTo=Millimeters)

# group: Преобразование параметра "диаметр" в текстовый параметр
string_from_object_4 = FromObject(convert_between_units_4)
code_block_37 = CodeBlock { ","; }
split_4 = String.Split(string_from_object_4, code_block_37)
transpose_4 = List.Transpose(split_4)
code_block_38 = CodeBlock(p=transpose_4) { p[0]; }

# group: Сравнение списков
toNumber_4 = String.ToNumber(code_block_38)
firstIndexOf_4 = List.FirstIndexOf(list=create_8, item=toNumber_4)
getItemAtIndex_4 = List.GetItemAtIndex(list=create_7, index=firstIndexOf_4)

# group: Сборка текста
code_block_39 = CodeBlock { "ADSK_Наименование"; }
setParameterByName_6 = Element.SetParameterByName(element=filterByBoolMask_6.in, parameterName=code_block_39, value=getItemAtIndex_4)

# group: Фильтрация выборки воздуховодов по значения параметра "Тип трубопровода"
code_block_40 = CodeBlock { "Тип трубопровода"; }
getParameterValueByNameTypeOrInstance_5 = Rhythm.Revit.Elements.Element.GetParameterValueByNameTypeOrInstance(filterByBoolMask_2.out, code_block_40)
toString_9 = Custom[Number.ToString](num=getParameterValueByNameTypeOrInstance_5)
number_5 = DoubleInput(2.2)
toString_10 = Custom[Number.ToString](num=number_5)
contains_7 = String.Contains(str=toString_9, searchFor=toString_10)
filterByBoolMask_7 = List.FilterByBoolMask(list=filterByBoolMask_2.out, mask=contains_7)

# group: Списки_
code_block_41 = CodeBlock()
# ---------- code_block_41.designscript (4 lines) ----------
"Труба из сшитого полиэтилена ø16х2.2";
"Труба из сшитого полиэтилена ø20х2.8";
"Труба из сшитого полиэтилена ø25х3.2";
"Труба из сшитого полиэтилена ø32х2.9";
# ----------------------------------------
create_9 = List.Create(code_block_41.out0, code_block_41.out1, code_block_41.out2, code_block_41.out3)
code_block_42 = CodeBlock { 16; 20; 25; 32; }
create_10 = List.Create(code_block_42.out0, code_block_42.out1, code_block_42.out2, code_block_42.out3)

# group: Выбор параметра "диаметр" воздуховодов и конвертация величины в миллиметны
code_block_43 = CodeBlock { "Диаметр"; }
getParameterValueByName_10 = Element.GetParameterValueByName(element=filterByBoolMask_7.in, parameterName=code_block_43)
convert_between_units_5 = DynamoConvert(getParameterValueByName_10, conversionMetric=Length, conversionFrom=Feet, conversionTo=Millimeters)

# group: Преобразование параметра "диаметр" в текстовый параметр
string_from_object_5 = FromObject(convert_between_units_5)
code_block_44 = CodeBlock { ","; }
split_5 = String.Split(string_from_object_5, code_block_44)
transpose_5 = List.Transpose(split_5)
code_block_45 = CodeBlock(p=transpose_5) { p[0]; }

# group: Сравнение списков
toNumber_5 = String.ToNumber(code_block_45)
firstIndexOf_5 = List.FirstIndexOf(list=create_10, item=toNumber_5)
getItemAtIndex_5 = List.GetItemAtIndex(list=create_9, index=firstIndexOf_5)

# group: Сборка текста
code_block_46 = CodeBlock { "ADSK_Наименование"; }
setParameterByName_7 = Element.SetParameterByName(element=filterByBoolMask_7.in, parameterName=code_block_46, value=getItemAtIndex_5)

# group: Фильтрация выборки воздуховодов по значения параметра "Тип трубопровода"
code_block_47 = CodeBlock { "Тип трубопровода"; }
getParameterValueByNameTypeOrInstance_6 = Rhythm.Revit.Elements.Element.GetParameterValueByNameTypeOrInstance(filterByBoolMask_2.out, code_block_47)
toString_11 = Custom[Number.ToString](num=getParameterValueByNameTypeOrInstance_6)
number_6 = DoubleInput(3.1)
toString_12 = Custom[Number.ToString](num=number_6)
contains_8 = String.Contains(str=toString_11, searchFor=toString_12)
filterByBoolMask_8 = List.FilterByBoolMask(list=filterByBoolMask_2.out, mask=contains_8)

# group: Списки_
code_block_48 = CodeBlock()
# ---------- code_block_48.designscript (4 lines) ----------
"Труба металлопластиковая ø16х2.2";
"Труба металлопластиковая ø20х2.25";
"Труба металлопластиковая ø25х2.5";
"Труба металлопластиковая ø32х3.0";
# ----------------------------------------
create_11 = List.Create(code_block_48.out0, code_block_48.out1, code_block_48.out2, code_block_48.out3)
code_block_49 = CodeBlock { 16; 20; 25; 32; }
create_12 = List.Create(code_block_49.out0, code_block_49.out1, code_block_49.out2, code_block_49.out3)

# group: Выбор параметра "диаметр" воздуховодов и конвертация величины в миллиметны
code_block_50 = CodeBlock { "Диаметр"; }
getParameterValueByName_11 = Element.GetParameterValueByName(element=filterByBoolMask_8.in, parameterName=code_block_50)
convert_between_units_6 = DynamoConvert(getParameterValueByName_11, conversionMetric=Length, conversionFrom=Feet, conversionTo=Millimeters)

# group: Преобразование параметра "диаметр" в текстовый параметр
string_from_object_6 = FromObject(convert_between_units_6)
code_block_51 = CodeBlock { ","; }
split_6 = String.Split(string_from_object_6, code_block_51)
transpose_6 = List.Transpose(split_6)
code_block_52 = CodeBlock(p=transpose_6) { p[0]; }

# group: Сравнение списков
toNumber_6 = String.ToNumber(code_block_52)
firstIndexOf_6 = List.FirstIndexOf(list=create_12, item=toNumber_6)
getItemAtIndex_6 = List.GetItemAtIndex(list=create_11, index=firstIndexOf_6)

# group: Сборка текста
code_block_53 = CodeBlock { "ADSK_Наименование"; }
setParameterByName_8 = Element.SetParameterByName(element=filterByBoolMask_8.in, parameterName=code_block_53, value=getItemAtIndex_6)

# group: Фильтрация выборки воздуховодов по значения параметра "Тип трубопровода"
code_block_54 = CodeBlock { "Тип трубопровода"; }
getParameterValueByNameTypeOrInstance_7 = Rhythm.Revit.Elements.Element.GetParameterValueByNameTypeOrInstance(filterByBoolMask_2.out, code_block_54)
toString_13 = Custom[Number.ToString](num=getParameterValueByNameTypeOrInstance_7)
number_7 = DoubleInput(5.1)
toString_14 = Custom[Number.ToString](num=number_7)
contains_9 = String.Contains(str=toString_13, searchFor=toString_14)
filterByBoolMask_9 = List.FilterByBoolMask(list=filterByBoolMask_2.out, mask=contains_9)

# group: Списки_
code_block_55 = CodeBlock()
# ---------- code_block_55.designscript (13 lines) ----------
"Труба медная ø10х0.8";
"Труба медная ø12х1.0";
"Труба медная ø15х1.0";
"Труба медная ø18х1.0";
"Труба медная ø22х1.0";
"Труба медная ø28х1.0";
"Труба медная ø35х1.5";
"Труба медная ø42х1.5";
"Труба медная ø54х1.5";
"Труба медная ø64х2.0";
"Труба медная ø76.1х2.0";
"Труба медная ø88.9х2.0";
"Труба медная ø108х2.5";
# ----------------------------------------
create_13 = List.Create(code_block_55.out0, code_block_55.out1, code_block_55.out2, code_block_55.out3, code_block_55.out4, code_block_55.out5, code_block_55.out6, code_block_55.out7, code_block_55.out8, code_block_55.out9, code_block_55.out10, code_block_55.out11, code_block_55.out12)
code_block_56 = CodeBlock { 10; 12; 15; 18; 22; 28; 35; 42; 54; 64; 76.1; 88.9; 108; }
create_14 = List.Create(code_block_56.out0, code_block_56.out1, code_block_56.out2, code_block_56.out3, code_block_56.out4, code_block_56.out5, code_block_56.out6, code_block_56.out7, code_block_56.out8, code_block_56.out9, code_block_56.out10, code_block_56.out11, code_block_56.out12)

# group: Выбор параметра "диаметр" воздуховодов и конвертация величины в миллиметны
code_block_57 = CodeBlock { "Диаметр"; }
getParameterValueByName_12 = Element.GetParameterValueByName(element=filterByBoolMask_9.in, parameterName=code_block_57)
convert_between_units_7 = DynamoConvert(getParameterValueByName_12, conversionMetric=Length, conversionFrom=Feet, conversionTo=Millimeters)

# group: Преобразование параметра "диаметр" в текстовый параметр
string_from_object_7 = FromObject(convert_between_units_7)
code_block_58 = CodeBlock { ","; }
split_7 = String.Split(string_from_object_7, code_block_58)
transpose_7 = List.Transpose(split_7)
code_block_59 = CodeBlock(p=transpose_7) { p[0]; }

# group: Сравнение списков
toNumber_7 = String.ToNumber(code_block_59)
firstIndexOf_7 = List.FirstIndexOf(list=create_14, item=toNumber_7)
getItemAtIndex_7 = List.GetItemAtIndex(list=create_13, index=firstIndexOf_7)

# group: Сборка текста
code_block_60 = CodeBlock { "ADSK_Наименование"; }
setParameterByName_9 = Element.SetParameterByName(element=filterByBoolMask_9.in, parameterName=code_block_60, value=getItemAtIndex_7)

# group: Фильтрация выборки воздуховодов по значения параметра "Тип трубопровода"
code_block_61 = CodeBlock { "Тип трубопровода"; }
getParameterValueByNameTypeOrInstance_8 = Rhythm.Revit.Elements.Element.GetParameterValueByNameTypeOrInstance(filterByBoolMask_2.out, code_block_61)
toString_15 = Custom[Number.ToString](num=getParameterValueByNameTypeOrInstance_8)
number_8 = DoubleInput(6.1)
toString_16 = Custom[Number.ToString](num=number_8)
contains_10 = String.Contains(str=toString_15, searchFor=toString_16)
filterByBoolMask_10 = List.FilterByBoolMask(list=filterByBoolMask_2.out, mask=contains_10)

# group: Списки_
code_block_62 = CodeBlock { "Труба чугунная раструбная ø50"; "Труба чугунная раструбная ø100"; "Труба чугунная раструбная ø150"; }
create_15 = List.Create(code_block_62.out0, code_block_62.out1, code_block_62.out2)
code_block_63 = CodeBlock { 50; 100; 150; }
create_16 = List.Create(code_block_63.out0, code_block_63.out1, code_block_63.out2)

# group: Выбор параметра "диаметр" воздуховодов и конвертация величины в миллиметны
code_block_64 = CodeBlock { "Диаметр"; }
getParameterValueByName_13 = Element.GetParameterValueByName(element=filterByBoolMask_10.in, parameterName=code_block_64)
convert_between_units_8 = DynamoConvert(getParameterValueByName_13, conversionMetric=Length, conversionFrom=Feet, conversionTo=Millimeters)

# group: Преобразование параметра "диаметр" в текстовый параметр
string_from_object_8 = FromObject(convert_between_units_8)
code_block_65 = CodeBlock { ","; }
split_8 = String.Split(string_from_object_8, code_block_65)
transpose_8 = List.Transpose(split_8)
code_block_66 = CodeBlock(p=transpose_8) { p[0]; }

# group: Сравнение списков
toNumber_8 = String.ToNumber(code_block_66)
firstIndexOf_8 = List.FirstIndexOf(list=create_16, item=toNumber_8)
getItemAtIndex_8 = List.GetItemAtIndex(list=create_15, index=firstIndexOf_8)

# group: Сборка текста
code_block_67 = CodeBlock { "ADSK_Наименование"; }
setParameterByName_10 = Element.SetParameterByName(element=filterByBoolMask_10.in, parameterName=code_block_67, value=getItemAtIndex_8)

# group: Фильтрация выборки воздуховодов по значения параметра "Тип трубопровода"
code_block_68 = CodeBlock { "Тип трубопровода"; }
getParameterValueByNameTypeOrInstance_9 = Rhythm.Revit.Elements.Element.GetParameterValueByNameTypeOrInstance(filterByBoolMask_2.out, code_block_68)
toString_17 = Custom[Number.ToString](num=getParameterValueByNameTypeOrInstance_9)
number_9 = DoubleInput(6.2)
toString_18 = Custom[Number.ToString](num=number_9)
contains_11 = String.Contains(str=toString_17, searchFor=toString_18)
filterByBoolMask_11 = List.FilterByBoolMask(list=filterByBoolMask_2.out, mask=contains_11)

# group: Списки_
code_block_69 = CodeBlock { "Труба чугунная безраструбная ø50"; "Труба чугунная безраструбная ø100"; "Труба чугунная безраструбная ø150"; }
create_17 = List.Create(code_block_69.out0, code_block_69.out1, code_block_69.out2)
code_block_70 = CodeBlock { 50; 100; 150; }
create_18 = List.Create(code_block_70.out0, code_block_70.out1, code_block_70.out2)

# group: Выбор параметра "диаметр" воздуховодов и конвертация величины в миллиметны
code_block_71 = CodeBlock { "Диаметр"; }
getParameterValueByName_14 = Element.GetParameterValueByName(element=filterByBoolMask_11.in, parameterName=code_block_71)
convert_between_units_9 = DynamoConvert(getParameterValueByName_14, conversionMetric=Length, conversionFrom=Feet, conversionTo=Millimeters)

# group: Преобразование параметра "диаметр" в текстовый параметр
string_from_object_9 = FromObject(convert_between_units_9)
code_block_72 = CodeBlock { ","; }
split_9 = String.Split(string_from_object_9, code_block_72)
transpose_9 = List.Transpose(split_9)
code_block_73 = CodeBlock(p=transpose_9) { p[0]; }

# group: Сравнение списков
toNumber_9 = String.ToNumber(code_block_73)
firstIndexOf_9 = List.FirstIndexOf(list=create_18, item=toNumber_9)
getItemAtIndex_9 = List.GetItemAtIndex(list=create_17, index=firstIndexOf_9)

# group: Сборка текста
code_block_74 = CodeBlock { "ADSK_Наименование"; }
setParameterByName_11 = Element.SetParameterByName(element=filterByBoolMask_11.in, parameterName=code_block_74, value=getItemAtIndex_9)

# group: Фильтрация выборки воздуховодов по значения параметра "Тип трубопровода"
code_block_75 = CodeBlock { "Тип трубопровода"; }
getParameterValueByNameTypeOrInstance_10 = Rhythm.Revit.Elements.Element.GetParameterValueByNameTypeOrInstance(filterByBoolMask_2.out, code_block_75)
toString_19 = Custom[Number.ToString](num=getParameterValueByNameTypeOrInstance_10)
number_10 = DoubleInput(1.3)
toString_20 = Custom[Number.ToString](num=number_10)
contains_12 = String.Contains(str=toString_19, searchFor=toString_20)
filterByBoolMask_12 = List.FilterByBoolMask(list=filterByBoolMask_2.out, mask=contains_12)

# group: Списки_
code_block_76 = CodeBlock()
# ---------- code_block_76.designscript (9 lines) ----------
"Труба полипропиленовая, армированная стекловолокном ø20";
"Труба полипропиленовая, армированная стекловолокном ø25";
"Труба полипропиленовая, армированная стекловолокном ø32";
"Труба полипропиленовая, армированная стекловолокном ø40";
"Труба полипропиленовая, армированная стекловолокном ø50";
"Труба полипропиленовая, армированная стекловолокном ø63";
"Труба полипропиленовая, армированная стекловолокном ø75";
"Труба полипропиленовая, армированная стекловолокном ø90";
"Труба полипропиленовая, армированная стекловолокном ø110";
# ----------------------------------------
create_19 = List.Create(code_block_76.out0, code_block_76.out1, code_block_76.out2, code_block_76.out3, code_block_76.out4, code_block_76.out5, code_block_76.out6, code_block_76.out7, code_block_76.out8)
code_block_77 = CodeBlock { 20; 25; 32; 40; 50; 63; 75; 90; 110; }
create_20 = List.Create(code_block_77.out0, code_block_77.out1, code_block_77.out2, code_block_77.out3, code_block_77.out4, code_block_77.out5, code_block_77.out6, code_block_77.out7, code_block_77.out8)

# group: Выбор параметра "диаметр" воздуховодов и конвертация величины в миллиметны
code_block_78 = CodeBlock { "Диаметр"; }
getParameterValueByName_15 = Element.GetParameterValueByName(element=filterByBoolMask_12.in, parameterName=code_block_78)
convert_between_units_10 = DynamoConvert(getParameterValueByName_15, conversionMetric=Length, conversionFrom=Feet, conversionTo=Millimeters)

# group: Преобразование параметра "диаметр" в текстовый параметр
string_from_object_10 = FromObject(convert_between_units_10)
code_block_79 = CodeBlock { ","; }
split_10 = String.Split(string_from_object_10, code_block_79)
transpose_10 = List.Transpose(split_10)
code_block_80 = CodeBlock(p=transpose_10) { p[0]; }

# group: Сравнение списков
toNumber_10 = String.ToNumber(code_block_80)
firstIndexOf_10 = List.FirstIndexOf(list=create_20, item=toNumber_10)
getItemAtIndex_10 = List.GetItemAtIndex(list=create_19, index=firstIndexOf_10)

# group: Сборка текста
code_block_81 = CodeBlock { "ADSK_Наименование"; }
setParameterByName_12 = Element.SetParameterByName(element=filterByBoolMask_12.in, parameterName=code_block_81, value=getItemAtIndex_10)

# group: Списки_
code_block_82 = CodeBlock()
# ---------- code_block_82.designscript (9 lines) ----------
"20740202331";
"20740252331";
"20740322331";
"20740402331";
"20740502331";
"20740632331";
"20740752331";
"20740902331";
"20741102331";
# ----------------------------------------
create_21 = List.Create(code_block_82.out0, code_block_82.out1, code_block_82.out2, code_block_82.out3, code_block_82.out4, code_block_82.out5, code_block_82.out6, code_block_82.out7, code_block_82.out8)
code_block_83 = CodeBlock { 20; 25; 32; 40; 50; 63; 75; 90; 110; }
create_22 = List.Create(code_block_83.out0, code_block_83.out1, code_block_83.out2, code_block_83.out3, code_block_83.out4, code_block_83.out5, code_block_83.out6, code_block_83.out7, code_block_83.out8)

# group: Выбор параметра "диаметр" воздуховодов и конвертация величины в миллиметны
code_block_84 = CodeBlock { "Диаметр"; }
getParameterValueByName_16 = Element.GetParameterValueByName(element=filterByBoolMask_12.in, parameterName=code_block_84)
convert_between_units_11 = DynamoConvert(getParameterValueByName_16, conversionMetric=Length, conversionFrom=Feet, conversionTo=Millimeters)

# group: Преобразование параметра "диаметр" в текстовый параметр
string_from_object_11 = FromObject(convert_between_units_11)
code_block_85 = CodeBlock { ","; }
split_11 = String.Split(string_from_object_11, code_block_85)
transpose_11 = List.Transpose(split_11)
code_block_86 = CodeBlock(p=transpose_11) { p[0]; }

# group: Сравнение списков
toNumber_11 = String.ToNumber(code_block_86)
firstIndexOf_11 = List.FirstIndexOf(list=create_22, item=toNumber_11)
getItemAtIndex_11 = List.GetItemAtIndex(list=create_21, index=firstIndexOf_11)

# group: Сборка текста
code_block_87 = CodeBlock { "ADSK_Код изделия"; }
setParameterByName_13 = Element.SetParameterByName(element=filterByBoolMask_12.in, parameterName=code_block_87, value=getItemAtIndex_11)
