# Dynamo graph 3.1.2_Проект_ADSK_Группирование.dyn (Dynamo 1.3.2.2480)

# group: Выбор всех элементов вентиляции из проекта
categories = Categories("PipeFittingCenterLine")
all_elements_of_category = ElementsOfCategory(categories)
categories_2 = Categories("FlexPipeCurves")
all_elements_of_category_2 = ElementsOfCategory(categories_2)
categories_3 = Categories("PipeCurves")
all_elements_of_category_3 = ElementsOfCategory(categories_3)
categories_4 = Categories("PlaceHolderPipes")
all_elements_of_category_4 = ElementsOfCategory(categories_4)
categories_5 = Categories("PipeFitting")
all_elements_of_category_5 = ElementsOfCategory(categories_5)
categories_6 = Categories("PipeAccessory")
all_elements_of_category_6 = ElementsOfCategory(categories_6)
categories_7 = Categories("MechanicalEquipment")
all_elements_of_category_7 = ElementsOfCategory(categories_7)
categories_8 = Categories("DuctTerminal")
all_elements_of_category_8 = ElementsOfCategory(categories_8)
categories_9 = Categories("PipeInsulations")
all_elements_of_category_9 = ElementsOfCategory(categories_9)
categories_10 = Categories("DuctLinings")
all_elements_of_category_10 = ElementsOfCategory(categories_10)
categories_11 = Categories("PlumbingFixtures")
all_elements_of_category_11 = ElementsOfCategory(categories_11)
join = List.Join(all_elements_of_category_2, all_elements_of_category_3, all_elements_of_category_4, all_elements_of_category_5, all_elements_of_category_6, all_elements_of_category_7, all_elements_of_category_8, all_elements_of_category_9, all_elements_of_category_10, all_elements_of_category_11)

# group: Хочу менять
по_экземпляру = StringInput("н/у в СП")

# group: Фильтрация выборки воздуховодов по значения параметра "ПР_Для фильтрации по экземпляру"
code_block = CodeBlock { "ПР_Для фильтрации по экземпляру"; }
getParameterValueByName = Element.GetParameterValueByName(element=join, parameterName=code_block)
contains = String.Contains(str=getParameterValueByName, searchFor=по_экземпляру)
filterByBoolMask = List.FilterByBoolMask(list=join, mask=contains)

# group: Хочу менять
по_типу = StringInput("н/у в СП")

# group: Фильтрация выборки воздуховодов по значения параметра "ПР_Для фильтрации по типу"
code_block_2 = CodeBlock { "ПР_Для фильтрации по типу"; }
get_type_parameter = Custom[Get Type Parameter](element=filterByBoolMask.out, parameterName=code_block_2)  # This node will retrieve a type parameter by its name.
code_block_3 = CodeBlock { " "; }
replaceNulls = Lists.Manage.ReplaceNulls(get_type_parameter, code_block_3)
contains_2 = String.Contains(str=replaceNulls, searchFor=по_типу)
filterByBoolMask_2 = List.FilterByBoolMask(list=filterByBoolMask.out, mask=contains_2)

# group: Копирование системного параметра "Имя системы" в общий параметр проекта "Система" с отделением по символу "=", до этого символа значения задаются параметру "Сисема_для марок", а после параметру "Система_для СП", если символа "=" нет, то значение присваивается обоим параметрам. Так же осуществляется разделение по символу "+"дополнительных знаков для разделения систем для ревита;
code_block_4 = CodeBlock { "ADSK_Группирование"; }
code_block_5 = CodeBlock { "Имя системы"; }
getParameterValueByName_2 = Element.GetParameterValueByName(element=filterByBoolMask_2.out, parameterName=code_block_5)
code_block_6 = CodeBlock { "="; }
split = String.Split(getParameterValueByName_2, code_block_6)
code_block_7 = CodeBlock { 0; }
getItemAtIndex = List.GetItemAtIndex(list=split, index=code_block_7, lacing=Longest)
setParameterByName = Element.SetParameterByName(element=filterByBoolMask_2.out, parameterName=code_block_4, value=getItemAtIndex)
code_block_8 = CodeBlock { 1; }
getItemAtIndex_2 = List.GetItemAtIndex(list=split, index=code_block_8, lacing=Longest)  # frozen
isNull = Object.IsNull(getItemAtIndex_2)
filterByBoolMask_3 = List.FilterByBoolMask(mask=isNull)  # unwired: list
code_block_9 = CodeBlock { "Система_ДляМарок"; }  # frozen
code_block_10 = CodeBlock { "+"; }
split_2 = String.Split(getItemAtIndex, code_block_10)
code_block_11 = CodeBlock { 0; }
getItemAtIndex_3 = List.GetItemAtIndex(list=split_2, index=code_block_11, lacing=Longest)
filterByBoolMask_4 = List.FilterByBoolMask(list=getItemAtIndex_3, mask=isNull)
setParameterByName_2 = Element.SetParameterByName(element=filterByBoolMask_3.in, parameterName=code_block_9, value=filterByBoolMask_4.in)  # frozen
removeNulls = Lists.Manage.RemoveNulls(getItemAtIndex_2)
split_3 = String.Split(removeNulls, code_block_10)
code_block_12 = CodeBlock { 0; }
getItemAtIndex_4 = List.GetItemAtIndex(list=split_3, index=code_block_12, lacing=Longest)
setParameterByName_3 = Element.SetParameterByName(element=filterByBoolMask_3.out, parameterName=code_block_9, value=getItemAtIndex_4)  # frozen
