# Dynamo graph 3.2.1_СП_Группирование.dyn (Dynamo 2.0.2.6826)

# group: Выбираем все элементы вентиляционной системы
boolean = BoolSelector(false)  # graph input
python_script = Python(IN[0]=boolean)
# ---------- python_script.python (50 lines) ----------
import clr

clr.AddReference('RevitAPI')
from Autodesk.Revit.DB import *
from Autodesk.Revit.DB.Structure import *

clr.AddReference('RevitAPIUI')
from Autodesk.Revit.UI import *

clr.AddReference('System')
from System.Collections.Generic import List

clr.AddReference('RevitNodes')
import Revit
clr.ImportExtensions(Revit.GeometryConversion)
clr.ImportExtensions(Revit.Elements)

clr.AddReference('RevitServices')
import RevitServices
from RevitServices.Persistence import DocumentManager
from RevitServices.Transactions import TransactionManager

doc = DocumentManager.Instance.CurrentDBDocument
uidoc=DocumentManager.Instance.CurrentUIApplication.ActiveUIDocument

#Preparing input from dynamo to revit


DuctCurves = FilteredElementCollector(doc).OfCategory(BuiltInCategory.OST_DuctCurves).WhereElementIsNotElementType().ToElements()
FlexDuctCurves = FilteredElementCollector(doc).OfCategory(BuiltInCategory.OST_FlexDuctCurves).WhereElementIsNotElementType().ToElements()
PlaceHolderDucts = FilteredElementCollector(doc).OfCategory(BuiltInCategory.OST_PlaceHolderDucts).WhereElementIsNotElementType().ToElements()

DuctFitting = FilteredElementCollector(doc).OfCategory(BuiltInCategory.OST_DuctFitting).WhereElementIsNotElementType().ToElements()

DuctInsulations = FilteredElementCollector(doc).OfCategory(BuiltInCategory.OST_DuctInsulations).WhereElementIsNotElementType().ToElements()
DuctLinings = FilteredElementCollector(doc).OfCategory(BuiltInCategory.OST_DuctLinings).WhereElementIsNotElementType().ToElements()

DuctTerminal = FilteredElementCollector(doc).OfCategory(BuiltInCategory.OST_DuctTerminal).WhereElementIsNotElementType().ToElements()
DuctAccessory = FilteredElementCollector(doc).OfCategory(BuiltInCategory.OST_DuctAccessory).WhereElementIsNotElementType().ToElements()

MechanicalEquipment = FilteredElementCollector(doc).OfCategory(BuiltInCategory.OST_MechanicalEquipment).WhereElementIsNotElementType().ToElements()

ele = DuctCurves, FlexDuctCurves, PlaceHolderDucts, DuctFitting, DuctInsulations, DuctLinings, DuctTerminal, DuctAccessory, MechanicalEquipment


TransactionManager.Instance.EnsureInTransaction(doc)

TransactionManager.Instance.TransactionTaskDone()

OUT = ele
# ----------------------------------------
flatten = List.Flatten(list=python_script)

# group: Хочу менять
по_экземпляру = StringInput("н/у в СП")

# group: Фильтрация выборки воздуховодов по значения параметра "ПР_Для фильтрации по экземпляру"
code_block = CodeBlock { "ПР_Для фильтрации по экземпляру"; }
getParameterValueByName = Element.GetParameterValueByName(element=flatten, parameterName=code_block)
contains = String.Contains(str=getParameterValueByName, searchFor=по_экземпляру)
filterByBoolMask = List.FilterByBoolMask(list=flatten, mask=contains)

# group: Хочу менять
по_типу = StringInput("н/у в СП")

# group: Фильтрация выборки воздуховодов по значения параметра "ПР_Для фильтрации по типу"
code_block_2 = CodeBlock { "ПР_Для фильтрации по типу"; }
get_type_parameter = Custom[Get Type Parameter](element=filterByBoolMask.out, parameterName=code_block_2)  # This node will retrieve a type parameter by its name.
code_block_3 = CodeBlock { " "; }
replaceNulls = Lists.Manage.ReplaceNulls(Data=get_type_parameter, ReplaceWith=code_block_3)
contains_2 = String.Contains(str=replaceNulls, searchFor=по_типу)
filterByBoolMask_2 = List.FilterByBoolMask(list=filterByBoolMask.out, mask=contains_2)

# group: Копирование системного параметра "Имя системы" в общий параметр проекта "Система" с отделением по символу "=", до этого символа значения задаются параметру "Сисема_для марок", а после параметру "Система_для СП", если символа "=" нет, то значение присваивается обоим параметрам. Так же осуществляется разделение по символу "+"дополнительных знаков для разделения систем для ревита;
code_block_4 = CodeBlock { "ADSK_Группирование"; }
code_block_5 = CodeBlock { "Имя системы"; }
getParameterValueByName_2 = Element.GetParameterValueByName(element=filterByBoolMask_2.out, parameterName=code_block_5)
code_block_6 = CodeBlock { "_"; }
split = String.Split(str=getParameterValueByName_2, separater0=code_block_6)
code_block_7 = CodeBlock { 0; }
getItemAtIndex = List.GetItemAtIndex(list=split, index=code_block_7, lacing=Longest)
setParameterByName = Element.SetParameterByName(element=filterByBoolMask_2.out, parameterName=code_block_4, value=getItemAtIndex)
code_block_8 = CodeBlock { 1; }
getItemAtIndex_2 = List.GetItemAtIndex(list=split, index=code_block_8, lacing=Longest)  # frozen
isNull = Object.IsNull(obj=getItemAtIndex_2)
filterByBoolMask_3 = List.FilterByBoolMask(mask=isNull)  # unwired: list
code_block_9 = CodeBlock { "Система_ДляМарок"; }  # frozen
code_block_10 = CodeBlock { "+"; }
split_2 = String.Split(str=getItemAtIndex, separater0=code_block_10)
code_block_11 = CodeBlock { 0; }
getItemAtIndex_3 = List.GetItemAtIndex(list=split_2, index=code_block_11, lacing=Longest)
filterByBoolMask_4 = List.FilterByBoolMask(list=getItemAtIndex_3, mask=isNull)
setParameterByName_2 = Element.SetParameterByName(element=filterByBoolMask_3.in, parameterName=code_block_9, value=filterByBoolMask_4.in)  # frozen
removeNulls = Lists.Manage.RemoveNulls(Data=getItemAtIndex_2)
split_3 = String.Split(str=removeNulls.Cleaned, separater0=code_block_10)
code_block_12 = CodeBlock { 0; }
getItemAtIndex_4 = List.GetItemAtIndex(list=split_3, index=code_block_12, lacing=Longest)
setParameterByName_3 = Element.SetParameterByName(element=filterByBoolMask_3.out, parameterName=code_block_9, value=getItemAtIndex_4)  # frozen
