# Dynamo graph 3.2.2_СП_Воздуховод.dyn (Dynamo 2.0.3.8810)

# group: Выбираем все элементы вентиляционной системы
boolean = BoolSelector(true)  # graph input
python_script = Python(IN[0]=boolean)
# ---------- python_script.python (50 lines) ----------
import clr

clr.AddReference('RevitAPI')
from Autodesk.Revit.DB import *
from Autodesk.Revit.DB.Structure import *

clr.AddReference('RevitAPIUI')
from Autodesk.Revit.UI import *

clr.AddReference('System')
from System.Collections.Generic import List

clr.AddReference('RevitNodes')
import Revit
clr.ImportExtensions(Revit.GeometryConversion)
clr.ImportExtensions(Revit.Elements)

clr.AddReference('RevitServices')
import RevitServices
from RevitServices.Persistence import DocumentManager
from RevitServices.Transactions import TransactionManager

doc = DocumentManager.Instance.CurrentDBDocument
uidoc=DocumentManager.Instance.CurrentUIApplication.ActiveUIDocument

#Preparing input from dynamo to revit


DuctCurves = FilteredElementCollector(doc).OfCategory(BuiltInCategory.OST_DuctCurves).WhereElementIsNotElementType().ToElements()
FlexDuctCurves = FilteredElementCollector(doc).OfCategory(BuiltInCategory.OST_FlexDuctCurves).WhereElementIsNotElementType().ToElements()
PlaceHolderDucts = FilteredElementCollector(doc).OfCategory(BuiltInCategory.OST_PlaceHolderDucts).WhereElementIsNotElementType().ToElements()

DuctFitting = FilteredElementCollector(doc).OfCategory(BuiltInCategory.OST_DuctFitting).WhereElementIsNotElementType().ToElements()

DuctInsulations = FilteredElementCollector(doc).OfCategory(BuiltInCategory.OST_DuctInsulations).WhereElementIsNotElementType().ToElements()
DuctLinings = FilteredElementCollector(doc).OfCategory(BuiltInCategory.OST_DuctLinings).WhereElementIsNotElementType().ToElements()

DuctTerminal = FilteredElementCollector(doc).OfCategory(BuiltInCategory.OST_DuctTerminal).WhereElementIsNotElementType().ToElements()
DuctAccessory = FilteredElementCollector(doc).OfCategory(BuiltInCategory.OST_DuctAccessory).WhereElementIsNotElementType().ToElements()

MechanicalEquipment = FilteredElementCollector(doc).OfCategory(BuiltInCategory.OST_MechanicalEquipment).WhereElementIsNotElementType().ToElements()

ele = DuctCurves, FlexDuctCurves, PlaceHolderDucts, DuctFitting, DuctInsulations, DuctLinings, DuctTerminal, DuctAccessory, MechanicalEquipment


TransactionManager.Instance.EnsureInTransaction(doc)

TransactionManager.Instance.TransactionTaskDone()

OUT = DuctCurves
# ----------------------------------------
flatten = List.Flatten(list=python_script)

# group: Хочу менять
фильтр_по_изоляции = StringInput("Строительные конструкции")  # graph input

# group: Фильтрация выборки воздуховодов по значения параметра "Тип изоляции"
code_block = CodeBlock { "Тип изоляции"; }
getParameterValueByName = Element.GetParameterValueByName(element=flatten, parameterName=code_block)
contains = String.Contains(str=getParameterValueByName, searchFor=фильтр_по_изоляции)
filterByBoolMask = List.FilterByBoolMask(list=flatten, mask=contains)

# group: Хочу менять
фильтр_по_экземпляру = StringInput("н/у в СП")  # graph input

# group: Фильтрация выборки воздуховодов по значения параметра "ПР_Для фильтрации по экземпляру"
code_block_2 = CodeBlock { "ПР_Для фильтрации по экземпляру"; }
getParameterValueByName_2 = Element.GetParameterValueByName(element=filterByBoolMask.out, parameterName=code_block_2)
contains_2 = String.Contains(str=getParameterValueByName_2, searchFor=фильтр_по_экземпляру)
filterByBoolMask_2 = List.FilterByBoolMask(list=filterByBoolMask.out, mask=contains_2)

# group: Хочу менять
фильтр_по_типу = StringInput("н/у в СП")  # graph input

# group: Фильтрация выборки воздуховодов по значения параметра "ПР_Для фильтрации по типу"
code_block_3 = CodeBlock { "ПР_Для фильтрации по типу"; }
get_type_parameter = Custom[Get Type Parameter](element=filterByBoolMask_2.out, parameterName=code_block_3)  # This node will retrieve a type parameter by its name.
code_block_4 = CodeBlock { " "; }
replaceNulls = Lists.Manage.ReplaceNulls(Data=get_type_parameter, ReplaceWith=code_block_4)
contains_3 = String.Contains(str=replaceNulls, searchFor=фильтр_по_типу)
filterByBoolMask_3 = List.FilterByBoolMask(list=filterByBoolMask_2.out, mask=contains_3)

# group: Фильтрация выборки воздуховодов по значения параметра "Тип изоляции"
string = StringInput("Семейство")
parameterByName = Parameter.ParameterByName(element=filterByBoolMask_3.out, name=string)
string_from_object = FromObject(obj=parameterByName)
фильтр_по_изоляции_2 = StringInput("Воздуховод круглого сечения")  # graph input
contains_4 = String.Contains(str=string_from_object, searchFor=фильтр_по_изоляции_2)
filterByBoolMask_4 = List.FilterByBoolMask(list=filterByBoolMask_3.out, mask=contains_4)

# group: Фильтрация выборки воздуховодов по значения параметра "Тип изоляции"
string_2 = StringInput("Тип")
parameterByName_2 = Parameter.ParameterByName(element=filterByBoolMask_4.out, name=string_2)
string_from_object_2 = FromObject(obj=parameterByName_2)
фильтр_по_изоляции_3 = StringInput("Пр_Врезка_Черн")  # graph input
contains_5 = String.Contains(str=string_from_object_2, searchFor=фильтр_по_изоляции_3)
filterByBoolMask_5 = List.FilterByBoolMask(list=filterByBoolMask_4.out, mask=contains_5)

# group: Фильтрация списка воздуховодов по значению параметра "Тип изоляции" Задание, для воздуховодов имеющих предел огнестойкости, толщины стенки болеше 0.8 мм,
code_block_5 = CodeBlock { "Толщина изоляции"; }
getParameterValueByName_3 = Element.GetParameterValueByName(element=filterByBoolMask_5.out, parameterName=code_block_5)
code_block_6 = CodeBlock { 0; }
gt = getParameterValueByName_3 > code_block_6
filterByBoolMask_6 = List.FilterByBoolMask(list=filterByBoolMask_5.out, mask=gt)
code_block_7 = CodeBlock { "Тип изоляции"; }

# group: Вписывание выбранного значения толщины стенки в параметр "Воздуховод_Толщина стенки"
code_block_8 = CodeBlock { "ADSK_Толщина стенки"; }
code_block_9 = CodeBlock { "0.80"; }
toNumber = String.ToNumber(str=code_block_9)
setParameterByName = Element.SetParameterByName(element=filterByBoolMask_6.in, parameterName=code_block_8, value=toNumber)

# group: Берем основной текст для заполнения параметра "СП_Наименование и техническая характеристика" из специально созданного параметра типа.
code_block_10 = CodeBlock { "Описание"; }
get_type_parameter_2 = Custom[Get Type Parameter](element=filterByBoolMask_5.out, parameterName=code_block_10)

# group: Выбор параметров "высота" и "ширина" воздуховодов
code_block_11 = CodeBlock { "Высота"; }
getParameterValueByName_4 = Element.GetParameterValueByName(element=filterByBoolMask_6.in, parameterName=code_block_11)
code_block_12 = CodeBlock { "Ширина"; }
getParameterValueByName_5 = Element.GetParameterValueByName(element=filterByBoolMask_6.in, parameterName=code_block_12)

# group: Выбор максимального и минимального значения параметров
min = Math.Min(int1=getParameterValueByName_4, int2=getParameterValueByName_5)
max = Math.Max(int1=getParameterValueByName_4, int2=getParameterValueByName_5)

# group: Преобразование параметров "высота" и "ширина" в текстовый параметр и избавление от нулей
string_from_object_3 = FromObject(obj=min)
code_block_13 = CodeBlock { ","; }
split = String.Split(str=string_from_object_3, separater0=code_block_13)
transpose = List.Transpose(lists=split)
code_block_14 = CodeBlock(p=transpose) { p[0]; }
string_from_object_4 = FromObject(obj=max)
code_block_15 = CodeBlock { ","; }
split_2 = String.Split(str=string_from_object_4, separater0=code_block_15)
transpose_2 = List.Transpose(lists=split_2)
code_block_16 = CodeBlock(p=transpose_2) { p[0]; }

# group: Сборка текста и вставка в строку параметра воздуховода "СП_Наименование и техническая характеристика";
code_block_17 = CodeBlock { "ADSK_Наименование"; }
code_block_18 = CodeBlock(a=get_type_parameter_2, b=code_block_9, c=code_block_14, d=code_block_16) { a+" S не менее " + b +" мм                                  "+c+"x"+d; }
setParameterByName_2 = Element.SetParameterByName(element=filterByBoolMask_6.in, parameterName=code_block_17, value=code_block_18)

# group: Фильтрация списка воздуховодов по значению параметра "Тип изоляции" Задание, для воздуховодов имеющих предел огнестойкости, толщины стенки болеше 0.8 мм,
code_block_19 = CodeBlock { "Толщина изоляции"; }
getParameterValueByName_6 = Element.GetParameterValueByName(element=filterByBoolMask_4.in, parameterName=code_block_19)
code_block_20 = CodeBlock { 0; }
gt_2 = getParameterValueByName_6 > code_block_20
filterByBoolMask_7 = List.FilterByBoolMask(list=filterByBoolMask_4.in, mask=gt_2)
code_block_21 = CodeBlock { "Тип изоляции"; }

# group: Вписывание выбранного значения толщины стенки в параметр "Воздуховод_Толщина стенки"
code_block_22 = CodeBlock { "ADSK_Толщина стенки"; }
code_block_23 = CodeBlock { "1.00"; }
toNumber_2 = String.ToNumber(str=code_block_23)
setParameterByName_3 = Element.SetParameterByName(element=filterByBoolMask_7.in, parameterName=code_block_22, value=toNumber_2)

# group: Выбор параметра "диаметр" воздуховодов и конвертация величины в миллиметны
code_block_24 = CodeBlock { "Диаметр"; }
getParameterValueByName_7 = Element.GetParameterValueByName(element=filterByBoolMask_7.out, parameterName=code_block_24)

# group: Выбор толщины стенки воздуховода по диаметру
code_block_25 = CodeBlock { 315; }
ge = code_block_25 >= getParameterValueByName_7
code_block_26 = CodeBlock { "0.55"; }
code_block_27 = CodeBlock { 800; }
le = getParameterValueByName_7 <= code_block_27
code_block_28 = CodeBlock { "0.70"; }
code_block_29 = CodeBlock { "1.00"; }
if_ = If(test=le, true=code_block_28, false=code_block_29)
if_2 = If(test=ge, true=code_block_26, false=if_)

# group: Вписывание выбранного значения толщины стенки в параметр "Воздуховод_Толщина стенки"
code_block_30 = CodeBlock { "ADSK_Толщина стенки"; }
toNumber_3 = String.ToNumber(str=if_2)
setParameterByName_4 = Element.SetParameterByName(element=filterByBoolMask_7.out, parameterName=code_block_30, value=toNumber_3)

# group: Выбор параметров "высота" и "ширина" воздуховодов и конвертация величины в миллиметны
code_block_31 = CodeBlock { "Высота"; }
getParameterValueByName_8 = Element.GetParameterValueByName(element=filterByBoolMask_6.out, parameterName=code_block_31)
code_block_32 = CodeBlock { "Ширина"; }
getParameterValueByName_9 = Element.GetParameterValueByName(element=filterByBoolMask_6.out, parameterName=code_block_32)

# group: Выбор значения толщины стенки воздуховодов по ширине большей стенки
code_block_33 = CodeBlock { 250; }
max_2 = Math.Max(int1=getParameterValueByName_8, int2=getParameterValueByName_9)
ge_2 = code_block_33 >= max_2
code_block_34 = CodeBlock { "0.55"; }
code_block_35 = CodeBlock { 1000; }
gt_3 = max_2 > code_block_35
code_block_36 = CodeBlock { "1.00"; }
code_block_37 = CodeBlock { "0.70"; }
if_3 = If(test=gt_3, true=code_block_36, false=code_block_37)
if_4 = If(test=ge_2, true=code_block_34, false=if_3)

# group: Вписывание выбранного значения толщины стенки в параметр "Воздуховод_Толщина стенки"
code_block_38 = CodeBlock { "ADSK_Толщина стенки"; }
toNumber_4 = String.ToNumber(str=if_4)
setParameterByName_5 = Element.SetParameterByName(element=filterByBoolMask_6.out, parameterName=code_block_38, value=toNumber_4)

# group: Берем основной текст для заполнения параметра "СП_Наименование и техническая характеристика" из специально созданного параметра типа.
code_block_39 = CodeBlock { "Описание"; }
get_type_parameter_3 = Custom[Get Type Parameter](element=filterByBoolMask_4.in, parameterName=code_block_39)

# group: избавление от нулей
python_script_2 = Python(IN[0]=getParameterValueByName_7)
# ---------- python_script_2.python (5 lines) ----------
list = IN[0]
list1 = []
for i in list:
	list1.append(int(i))
OUT = list1
# ----------------------------------------

# group: Сборка текста и вставка в строку параметра воздуховода "СП_Наименование и техническая характеристика";
code_block_40 = CodeBlock { "ADSK_Наименование"; }
code_block_41 = CodeBlock(a=get_type_parameter_3, b=if_2, c=python_script_2) { a + " S=" + b + " мм                                                      ø"+c; }
setParameterByName_6 = Element.SetParameterByName(element=filterByBoolMask_7.out, parameterName=code_block_40, value=code_block_41)

# group: Выбор параметра "диаметр" воздуховодов и конвертация величины в миллиметны
code_block_42 = CodeBlock { "Диаметр"; }
getParameterValueByName_10 = Element.GetParameterValueByName(element=filterByBoolMask_7.in, parameterName=code_block_42)

# group: избавление от нулей
python_script_3 = Python(IN[0]=getParameterValueByName_10)  # same code as python_script_2

# group: Сборка текста и вставка в строку параметра воздуховода "СП_Наименование и техническая характеристика";
code_block_43 = CodeBlock { "ADSK_Наименование"; }
code_block_44 = CodeBlock(a=get_type_parameter_3, b=code_block_23, c=python_script_3) { a+b+" мм                                                      ø"+c; }
setParameterByName_7 = Element.SetParameterByName(element=filterByBoolMask_7.in, parameterName=code_block_43, value=code_block_44)

# group: Выбор максимального и минимального значения параметров
max_3 = Math.Max(int1=getParameterValueByName_8, int2=getParameterValueByName_9)
min_2 = Math.Min(int1=getParameterValueByName_8, int2=getParameterValueByName_9)

# group: Преобразование параметров "высота" и "ширина" в текстовый параметр и избавление от нулей
string_from_object_5 = FromObject(obj=max_3)
code_block_45 = CodeBlock { ","; }
split_3 = String.Split(str=string_from_object_5, separater0=code_block_45)
transpose_3 = List.Transpose(lists=split_3)
code_block_46 = CodeBlock(p=transpose_3) { p[0]; }
string_from_object_6 = FromObject(obj=min_2)
code_block_47 = CodeBlock { ","; }
split_4 = String.Split(str=string_from_object_6, separater0=code_block_47)
transpose_4 = List.Transpose(lists=split_4)
code_block_48 = CodeBlock(p=transpose_4) { p[0]; }

# group: Сборка текста и вставка в строку параметра воздуховода "СП_Наименование и техническая характеристика";
code_block_49 = CodeBlock { "ADSK_Наименование"; }
code_block_50 = CodeBlock(a=get_type_parameter_2, b=if_4, c=code_block_46, d=code_block_48) { a + " S=" + b + " мм                                  "+c+"x"+d; }
setParameterByName_8 = Element.SetParameterByName(element=filterByBoolMask_6.out, parameterName=code_block_49, value=code_block_50)

# group: Хочу менять
code_block_51 = CodeBlock { 1.2; }

# group: Переброс параметра длмна в параметр СП_Количество
code_block_52 = CodeBlock { "ADSK_Количество"; }
code_block_53 = CodeBlock { "Длина"; }
getParameterValueByName_11 = Element.GetParameterValueByName(element=filterByBoolMask_2.out, parameterName=code_block_53)
code_block_54 = CodeBlock(a=getParameterValueByName_11, b=code_block_51) { a*b/1000; }
setParameterByName_9 = Element.SetParameterByName(element=filterByBoolMask_2.out, parameterName=code_block_52, value=code_block_54)

code_block_55 = CodeBlock { "ADSK_Масса"; }

# group: Высчитываем массу и добавляем в СП_Масса
code_block_56 = CodeBlock { "Площадь"; }
getParameterValueByName_12 = Element.GetParameterValueByName(element=filterByBoolMask_2.out, parameterName=code_block_56)
code_block_57 = CodeBlock { "ADSK_Толщина стенки"; }
getParameterValueByName_13 = Element.GetParameterValueByName(element=filterByBoolMask_2.out, parameterName=code_block_57)
code_block_58 = CodeBlock(a=getParameterValueByName_12, b=code_block_51, c=getParameterValueByName_13) { 7.85*a*b*c; }
setParameterByName_10 = Element.SetParameterByName(element=filterByBoolMask_2.out, parameterName=code_block_55, value=code_block_58)

# group: Берем основной текст для заполнения параметра "СП_Наименование и техническая характеристика" из специально созданного параметра типа.
code_block_59 = CodeBlock { "Описание"; }
get_type_parameter_4 = Custom[Get Type Parameter](element=filterByBoolMask_5.in, parameterName=code_block_59)

# group: Выбор параметров "высота" и "ширина" воздуховодов и конвертация величины в миллиметны
code_block_60 = CodeBlock { "Высота"; }
getParameterValueByName_14 = Element.GetParameterValueByName(element=filterByBoolMask_5.in, parameterName=code_block_60)
code_block_61 = CodeBlock { "Ширина"; }
getParameterValueByName_15 = Element.GetParameterValueByName(element=filterByBoolMask_5.in, parameterName=code_block_61)

# group: Выбор максимального и минимального значения параметров
max_4 = Math.Max(int1=getParameterValueByName_14, int2=getParameterValueByName_15)
min_3 = Math.Min(int1=getParameterValueByName_14, int2=getParameterValueByName_15)

# group: Преобразование параметров "высота" и "ширина" в текстовый параметр и избавление от нулей
string_from_object_7 = FromObject(obj=max_4)
code_block_62 = CodeBlock { ","; }
split_5 = String.Split(str=string_from_object_7, separater0=code_block_62)
transpose_5 = List.Transpose(lists=split_5)
code_block_63 = CodeBlock(p=transpose_5) { p[0]; }
string_from_object_8 = FromObject(obj=min_3)
code_block_64 = CodeBlock { ","; }
split_6 = String.Split(str=string_from_object_8, separater0=code_block_64)
transpose_6 = List.Transpose(lists=split_6)
code_block_65 = CodeBlock(p=transpose_6) { p[0]; }

# group: Сборка текста и вставка в строку параметра воздуховода "СП_Наименование и техническая характеристика";
code_block_66 = CodeBlock { "ADSK_Наименование"; }
code_block_67 = CodeBlock(a=get_type_parameter_4, c=code_block_63, d=code_block_65) { a+" мм                                  "+c+"x"+d; }
setParameterByName_11 = Element.SetParameterByName(element=filterByBoolMask_5.in, parameterName=code_block_66, value=[code_block_67, code_block_67])
