# Dynamo graph 3.2.4_СП_Изоляция.dyn (Dynamo 2.0.2.6826)

# group: Выбираем все элементы вентиляционной системы
boolean = BoolSelector(true)  # graph input
python_script = Python(IN[0]=boolean)
# ---------- python_script.python (50 lines) ----------
import clr

clr.AddReference('RevitAPI')
from Autodesk.Revit.DB import *
from Autodesk.Revit.DB.Structure import *

clr.AddReference('RevitAPIUI')
from Autodesk.Revit.UI import *

clr.AddReference('System')
from System.Collections.Generic import List

clr.AddReference('RevitNodes')
import Revit
clr.ImportExtensions(Revit.GeometryConversion)
clr.ImportExtensions(Revit.Elements)

clr.AddReference('RevitServices')
import RevitServices
from RevitServices.Persistence import DocumentManager
from RevitServices.Transactions import TransactionManager

doc = DocumentManager.Instance.CurrentDBDocument
uidoc=DocumentManager.Instance.CurrentUIApplication.ActiveUIDocument

#Preparing input from dynamo to revit


DuctCurves = FilteredElementCollector(doc).OfCategory(BuiltInCategory.OST_DuctCurves).WhereElementIsNotElementType().ToElements()
FlexDuctCurves = FilteredElementCollector(doc).OfCategory(BuiltInCategory.OST_FlexDuctCurves).WhereElementIsNotElementType().ToElements()
PlaceHolderDucts = FilteredElementCollector(doc).OfCategory(BuiltInCategory.OST_PlaceHolderDucts).WhereElementIsNotElementType().ToElements()

DuctFitting = FilteredElementCollector(doc).OfCategory(BuiltInCategory.OST_DuctFitting).WhereElementIsNotElementType().ToElements()

DuctInsulations = FilteredElementCollector(doc).OfCategory(BuiltInCategory.OST_DuctInsulations).WhereElementIsNotElementType().ToElements()
DuctLinings = FilteredElementCollector(doc).OfCategory(BuiltInCategory.OST_DuctLinings).WhereElementIsNotElementType().ToElements()

DuctTerminal = FilteredElementCollector(doc).OfCategory(BuiltInCategory.OST_DuctTerminal).WhereElementIsNotElementType().ToElements()
DuctAccessory = FilteredElementCollector(doc).OfCategory(BuiltInCategory.OST_DuctAccessory).WhereElementIsNotElementType().ToElements()

MechanicalEquipment = FilteredElementCollector(doc).OfCategory(BuiltInCategory.OST_MechanicalEquipment).WhereElementIsNotElementType().ToElements()

ele = DuctCurves, FlexDuctCurves, PlaceHolderDucts, DuctFitting, DuctInsulations, DuctLinings, DuctTerminal, DuctAccessory, MechanicalEquipment


TransactionManager.Instance.EnsureInTransaction(doc)

TransactionManager.Instance.TransactionTaskDone()

OUT = DuctInsulations
# ----------------------------------------
flatten = List.Flatten(list=python_script)

# group: фильтр
фильтр_по_типу = StringInput("н/у в СП")  # graph input

# group: фильтр
фильтр_по_экземпляру = StringInput("н/у в СП")  # graph input

# group: Фильтрация списка всех элементов вентиляции по занчению параметров для фильтрации по типу и по экземпляру "н/у в СП"
code_block = CodeBlock { "ПР_Для фильтрации по типу"; }
get_type_parameter = Custom[Get Type Parameter](element=flatten, parameterName=code_block)  # This node will retrieve a type parameter by its name.
code_block_2 = CodeBlock { " "; }
replaceNulls = Lists.Manage.ReplaceNulls(Data=get_type_parameter, ReplaceWith=code_block_2)
contains = String.Contains(str=replaceNulls, searchFor=фильтр_по_типу)
filterByBoolMask = List.FilterByBoolMask(list=flatten, mask=contains)
code_block_3 = CodeBlock { "ПР_Для фильтрации по экземпляру"; }
getParameterValueByName = Element.GetParameterValueByName(element=filterByBoolMask.out, parameterName=code_block_3)
contains_2 = String.Contains(str=getParameterValueByName, searchFor=фильтр_по_экземпляру)
filterByBoolMask_2 = List.FilterByBoolMask(list=filterByBoolMask.out, mask=contains_2)

# group: ХОЧУ МЕНЯТЬ
запас = CodeBlock { 1.2; }

# group: Собираем все в СП_Количество
code_block_4 = CodeBlock { "ADSK_Количество"; }
code_block_5 = CodeBlock { "Площадь"; }
getParameterValueByName_2 = Element.GetParameterValueByName(element=filterByBoolMask_2.out, parameterName=code_block_5)
code_block_6 = CodeBlock(a=getParameterValueByName_2, b=запас) { a*b; }
setParameterByName = Element.SetParameterByName(element=filterByBoolMask_2.out, parameterName=code_block_4, value=code_block_6)

# group: Выбираем всю изоляцию и копируем в ADSK_Наименование и техническая характеристика
code_block_7 = CodeBlock { "ADSK_Наименование"; }
code_block_8 = CodeBlock { "Описание"; }
ʳʰʸᵗʰᵐ_elements = Rhythm.Revit.Elements.Elements.GetParameterValueByNameTypeOrInstance(element=flatten, parameterName=code_block_8)
ʳʰʸᵗʰᵐ_elements_2 = Rhythm.Revit.Elements.Elements.SetParameterByNameTypeOrInstance(element=flatten, parameterName=code_block_7, value=ʳʰʸᵗʰᵐ_elements)
