# Dynamo graph 3.2.5_СП_Фитинги.dyn (Dynamo 2.0.3.8810)

# group: Выбираем все элементы вентиляционной системы
boolean = BoolSelector(true)  # graph input
python_script = Python(IN[0]=boolean)
# ---------- python_script.python (50 lines) ----------
import clr

clr.AddReference('RevitAPI')
from Autodesk.Revit.DB import *
from Autodesk.Revit.DB.Structure import *

clr.AddReference('RevitAPIUI')
from Autodesk.Revit.UI import *

clr.AddReference('System')
from System.Collections.Generic import List

clr.AddReference('RevitNodes')
import Revit
clr.ImportExtensions(Revit.GeometryConversion)
clr.ImportExtensions(Revit.Elements)

clr.AddReference('RevitServices')
import RevitServices
from RevitServices.Persistence import DocumentManager
from RevitServices.Transactions import TransactionManager

doc = DocumentManager.Instance.CurrentDBDocument
uidoc=DocumentManager.Instance.CurrentUIApplication.ActiveUIDocument

#Preparing input from dynamo to revit


DuctCurves = FilteredElementCollector(doc).OfCategory(BuiltInCategory.OST_DuctCurves).WhereElementIsNotElementType().ToElements()
FlexDuctCurves = FilteredElementCollector(doc).OfCategory(BuiltInCategory.OST_FlexDuctCurves).WhereElementIsNotElementType().ToElements()
PlaceHolderDucts = FilteredElementCollector(doc).OfCategory(BuiltInCategory.OST_PlaceHolderDucts).WhereElementIsNotElementType().ToElements()

DuctFitting = FilteredElementCollector(doc).OfCategory(BuiltInCategory.OST_DuctFitting).WhereElementIsNotElementType().ToElements()

DuctInsulations = FilteredElementCollector(doc).OfCategory(BuiltInCategory.OST_DuctInsulations).WhereElementIsNotElementType().ToElements()
DuctLinings = FilteredElementCollector(doc).OfCategory(BuiltInCategory.OST_DuctLinings).WhereElementIsNotElementType().ToElements()

DuctTerminal = FilteredElementCollector(doc).OfCategory(BuiltInCategory.OST_DuctTerminal).WhereElementIsNotElementType().ToElements()
DuctAccessory = FilteredElementCollector(doc).OfCategory(BuiltInCategory.OST_DuctAccessory).WhereElementIsNotElementType().ToElements()

MechanicalEquipment = FilteredElementCollector(doc).OfCategory(BuiltInCategory.OST_MechanicalEquipment).WhereElementIsNotElementType().ToElements()

ele = DuctCurves, FlexDuctCurves, PlaceHolderDucts, DuctFitting, DuctInsulations, DuctLinings, DuctTerminal, DuctAccessory, MechanicalEquipment


TransactionManager.Instance.EnsureInTransaction(doc)

TransactionManager.Instance.TransactionTaskDone()

OUT = DuctFitting
# ----------------------------------------
flatten = List.Flatten(list=python_script)

# group: Хочу менять
фильтр_по_изоляции = StringInput("Строительные конструкции")  # graph input

# group: Фильтрация выборки воздуховодов по значения параметра "Тип изоляции"
code_block = CodeBlock { "Тип изоляции"; }
getParameterValueByName = Element.GetParameterValueByName(element=flatten, parameterName=code_block)
contains = String.Contains(str=getParameterValueByName, searchFor=фильтр_по_изоляции)
filterByBoolMask = List.FilterByBoolMask(list=flatten, mask=contains)

# group: Хочу менять
фильтр_по_экземпляру = StringInput("н/у в СП")  # graph input

# group: Фильтрация выборки воздуховодов по значения параметра "ПР_Для фильтрации по экземпляру"
code_block_2 = CodeBlock { "ПР_Для фильтрации по экземпляру"; }
getParameterValueByName_2 = Element.GetParameterValueByName(element=filterByBoolMask.out, parameterName=code_block_2)
contains_2 = String.Contains(str=getParameterValueByName_2, searchFor=фильтр_по_экземпляру)
filterByBoolMask_2 = List.FilterByBoolMask(list=filterByBoolMask.out, mask=contains_2)

# group: Хочу менять
фильтр_по_типу = StringInput("н/у в СП")  # graph input

# group: Фильтрация выборки воздуховодов по значения параметра "ПР_Для фильтрации по типу"
code_block_3 = CodeBlock { "ПР_Для фильтрации по типу"; }
get_type_parameter = Custom[Get Type Parameter](element=filterByBoolMask_2.out, parameterName=code_block_3)  # This node will retrieve a type parameter by its name.
code_block_4 = CodeBlock { " "; }
replaceNulls = Lists.Manage.ReplaceNulls(Data=get_type_parameter, ReplaceWith=code_block_4)
contains_3 = String.Contains(str=replaceNulls, searchFor=фильтр_по_типу)
filterByBoolMask_3 = List.FilterByBoolMask(list=filterByBoolMask_2.out, mask=contains_3)

# group: Фильтрация выборки воздуховодов по значения параметра "Тип изоляции"
string = StringInput("Тип")
parameterByName = Parameter.ParameterByName(element=filterByBoolMask_3.out, name=string)
string_from_object = FromObject(obj=parameterByName)
фильтр_по_изоляции_2 = StringInput("ЧернаяСталь")  # graph input
contains_4 = String.Contains(str=string_from_object, searchFor=фильтр_по_изоляции_2)
filterByBoolMask_4 = List.FilterByBoolMask(list=filterByBoolMask_3.out, mask=contains_4)

# group: Фильтрация списка воздуховодов по значению параметра "Тип изоляции" Задание, для воздуховодов имеющих предел огнестойкости, толщины стенки болеше 0.8 мм,
code_block_5 = CodeBlock { "Толщина изоляции"; }
getParameterValueByName_3 = Element.GetParameterValueByName(element=filterByBoolMask_4.out, parameterName=code_block_5)
code_block_6 = CodeBlock { 0; }
gt = getParameterValueByName_3 > code_block_6
filterByBoolMask_5 = List.FilterByBoolMask(list=filterByBoolMask_4.out, mask=gt)

# group: Берем основной текст для заполнения параметра "СП_Наименование и техническая характеристика" из специально созданного параметра типа.
code_block_7 = CodeBlock { "DY_СП_Наименование и техническая характеристика"; }
get_type_parameter_2 = Custom[Get Type Parameter](element=filterByBoolMask_5.in, parameterName=code_block_7)

# group: Вписывание выбранного значения толщины стенки в параметр "Воздуховод_Толщина стенки"
code_block_8 = CodeBlock { "0.80"; }

# group: Сборка текста и вставка в строку параметра воздуховода "СП_Наименование и техническая характеристика";
code_block_9 = CodeBlock { "ADSK_Наименование"; }
code_block_10 = CodeBlock(a=get_type_parameter_2, b=code_block_8) { a + b + " мм"; }
setParameterByName = Element.SetParameterByName(element=filterByBoolMask_5.in, parameterName=code_block_9, value=code_block_10)

# group: Берем основной текст для заполнения параметра "СП_Наименование и техническая характеристика" из специально созданного параметра типа.
code_block_11 = CodeBlock { "DY_СП_Наименование и техническая характеристика"; }
get_type_parameter_3 = Custom[Get Type Parameter](element=filterByBoolMask_5.out, parameterName=code_block_11)

# group: Перенос значений из параметра Воздуховод_Толщина стенки
code_block_12 = CodeBlock { "ADSK_Толщина стенки"; }
getParameterValueByName_4 = Element.GetParameterValueByName(element=filterByBoolMask_5.out, parameterName=code_block_12)

string_from_object_2 = FromObject(obj=getParameterValueByName_4)
code_block_13 = CodeBlock { 4; }
code_block_14 = CodeBlock { 4; }
remove = String.Remove(str=string_from_object_2, startIndex=code_block_13, count=code_block_14)

# group: Сборка текста и вставка в строку параметра воздуховода "СП_Наименование и техническая характеристика";
code_block_15 = CodeBlock { "ADSK_Наименование"; }
code_block_16 = CodeBlock(a=get_type_parameter_3, b=remove) { a+b+" мм"; }
setParameterByName_2 = Element.SetParameterByName(element=filterByBoolMask_5.out, parameterName=code_block_15, value=code_block_16)

# group: Хочу менять
запас = CodeBlock { 1.2; }

# group: Увеличение запаса по плащиди
code_block_17 = CodeBlock { "ADSK_Количество"; }
code_block_18 = CodeBlock { "Площадь элемента"; }
getParameterValueByName_5 = Element.GetParameterValueByName(element=filterByBoolMask_3.out, parameterName=code_block_18)
code_block_19 = CodeBlock(a=запас, b=getParameterValueByName_5) { a*b; }
setParameterByName_3 = Element.SetParameterByName(element=filterByBoolMask_3.out, parameterName=code_block_17, value=code_block_19)

# group: Масса для не изолированных воздуховодов
code_block_20 = CodeBlock { "ADSK_Масса"; }
code_block_21 = CodeBlock { "Площадь элемента"; }
getParameterValueByName_6 = Element.GetParameterValueByName(element=filterByBoolMask_5.out, parameterName=code_block_21)
code_block_22 = CodeBlock(a=запас, b=getParameterValueByName_6, c=getParameterValueByName_4) { a*7.85*b*c; }
setParameterByName_4 = Element.SetParameterByName(element=filterByBoolMask_5.out, parameterName=code_block_20, value=code_block_22)

code_block_23 = CodeBlock { "Площадь элемента"; }
getParameterValueByName_7 = Element.GetParameterValueByName(element=filterByBoolMask_5.in, parameterName=code_block_23)

# group: Масса для изолированных воздуховодов
code_block_24 = CodeBlock { "ADSK_Масса"; }
code_block_25 = CodeBlock(a=запас, b=getParameterValueByName_7) { a*7.85*b*1; }
setParameterByName_5 = Element.SetParameterByName(element=filterByBoolMask_5.in, parameterName=code_block_24, value=code_block_25)

# group: Берем основной текст для заполнения параметра "СП_Наименование и техническая характеристика" из специально созданного параметра типа.
code_block_26 = CodeBlock { "DY_СП_Наименование и техническая характеристика"; }
get_type_parameter_4 = Custom[Get Type Parameter](element=filterByBoolMask_4.in, parameterName=code_block_26)

# group: Вписывание выбранного значения толщины стенки в параметр "Воздуховод_Толщина стенки"
code_block_27 = CodeBlock { "1.20"; }

# group: Сборка текста и вставка в строку параметра воздуховода "СП_Наименование и техническая характеристика";
code_block_28 = CodeBlock { "ADSK_Наименование"; }
code_block_29 = CodeBlock(a=get_type_parameter_4, b=code_block_27) { a +"="+ b + " мм"; }
setParameterByName_6 = Element.SetParameterByName(element=filterByBoolMask_4.in, parameterName=code_block_28, value=code_block_29)
