# Dynamo graph 3.2.5_СП_Фитинги_Наименование_2.0.dyn (Dynamo 2.0.2.6826)

# note: Фильтрация выборки воздуховодов по значения параметра "ПР_Для фильтрации по экземпляру"
# note: Сборка текста и вставка в строку параметра воздуховода "СП_Наименование и техническая характеристика";
# note: Фильтрация списка воздуховодов по значению параметра "Тип изоляции"
# Задание, для воздуховодов имеющих предел огнестойкости, толщины стенки болеше 0.8 мм,
# note: Вписывание выбранного значения толщины стенки в параметр "Воздуховод_Толщина стенки"
# note: Берем основной текст для заполнения параметра "СП_Наименование и техническая характеристика" из специально созданного параметра типа.
# note: Фильтрация выборки воздуховодов по значения параметра "ПР_Для фильтрации по типу"
# note: Выбор фитингов в проекте
# note: Фильтрация выборки воздуховодов по значения параметра "Тип изоляции"
# note: Перенос значений из параметра Воздуховод_Толщина стенки
# note: Хочу менять
# note: Увеличение запаса по плащиди
# note: Масса для не изолированных воздуховодов
# note: Масса для изолированных воздуховодов
categories = Categories(index=510)  # graph input
all_elements_of_category = ElementsOfCategory(Category=categories)
python_script = Python(IN[0]=all_elements_of_category)
# ---------- python_script.python (16 lines) ----------
import clr
clr.AddReference('ProtoGeometry')
from Autodesk.DesignScript.Geometry import *
clr.AddReference('RevitAPI')
from Autodesk.Revit.DB import *
#Введенные в этом узле данные сохраняется в виде списка в переменных IN.
e = UnwrapElement(IN[0])
list=[]
list1=[]
for ex in e:
	list.append(ex.MEPModel.ConnectorManager.Connectors)
	list1.append(ex.Id)


#Назначьте вывод переменной OUT.
OUT = e, list, list1
# ----------------------------------------
python_script_2 = Python(IN[0]=python_script)
# ---------- python_script_2.python (34 lines) ----------
import clr
clr.AddReference('ProtoGeometry')
from Autodesk.DesignScript.Geometry import *
clr.AddReference('RevitAPI')
from Autodesk.Revit.DB import *
#Введенные в этом узле данные сохраняется в виде списка в переменных IN.
e = UnwrapElement(IN[0][0])
list1=[]
list2=[]
list3=[]
list4=[]
list5=[]
list6=[]

a=0
while a<e.Count:
	t=e[a].Symbol.Family.get_Parameter(BuiltInParameter.FAMILY_CONTENT_PART_TYPE).AsInteger()
	if t==5:#Отвод
		list1.append(e[a])
	elif t==6:#Тройник
		list2.append(e[a])
	elif t==7:#Переход
		list3.append(e[a])
	elif t==8:#Крестовина
		list4.append(e[a])
	elif t==9:#Заглушка
		list5.append(e[a])
	elif t==10:#Врезка
		list6.append(e[a])
	elif t==11:#Врезка
		list6.append(e[a])
	a=a+1
#Назначьте вывод переменной OUT.
OUT = list1, list2, list3, list4, list5, list6
# ----------------------------------------
python_script_3 = Python(IN[0]=python_script_2, IN[1]=python_script)
# ---------- python_script_3.python (64 lines) ----------
import clr
clr.AddReference('ProtoGeometry')
from Autodesk.DesignScript.Geometry import *
clr.AddReference('RevitAPI')
from Autodesk.Revit.DB import *

#Введенные в этом узле данные сохраняется в виде списка в переменных IN.
e = UnwrapElement(IN[0][4])
c = IN[1][1]
i = IN[1][2]

def FittingDuctName(x):
	FP=x.get_Parameter(BuiltInParameter.RBS_REFERENCE_INSULATION_TYPE).AsString()
	TypeCom = x.Symbol.get_Parameter(BuiltInParameter.ALL_MODEL_TYPE_COMMENTS).AsString()
	if TypeCom:
		ST=TypeCom
	else:
		ST="Заглушка оцинкованной из стали"
	
	II=i.index(x.Id)
	listz=[]
	for z in c[II]:
		if z.Shape.ToString() == "Rectangular":
			W = round(z.Width*304.8,0)
			listz.append(W)
			H = round(z.Height*304.8,0)
			listz.append(H)
			MXS = max(W, H)
			MNS = min(W, H)
			w=MXS.ToString()
			h="x" + MNS.ToString()
			SC = w + h
		elif z.Shape.ToString() == "Round":
			D = round(z.Radius*304.8*2,0)
			listz.append(D)
			SC = "Ø" + D.ToString()

		Mx = max(listz)
		Mn = min(listz)
	
	if FP and "EI" in FP:
		if Mx < 2001:
			t = 1.0
		else:
			t = 1.2

	else:
		if Mx < 251:
			t = 0.55
		elif Mx < 1001:
			t = 0.7
		elif Mx < 2001:
			t = 1.0
		else:
			t = 1.2
	
	return ST + " толщиной " + t.ToString() + " мм" + " " + SC


a=FittingDuctName(e[0])
p=[]
for el in e:
	p.append(FittingDuctName(el))
OUT = p, e
# ----------------------------------------
code_block = CodeBlock(a=python_script_3, c=python_script_3) { a[1]; c[0]; }
string = StringInput("ADSK_Наименование")
setParameterByName = Element.SetParameterByName(element=code_block.out0, parameterName=string, value=code_block.out1)
python_script_4 = Python(IN[0]=python_script_2, IN[1]=python_script)
# ---------- python_script_4.python (64 lines) ----------
import clr
clr.AddReference('ProtoGeometry')
from Autodesk.DesignScript.Geometry import *
clr.AddReference('RevitAPI')
from Autodesk.Revit.DB import *

#Введенные в этом узле данные сохраняется в виде списка в переменных IN.
e = UnwrapElement(IN[0][5])
c = IN[1][1]
i = IN[1][2]

def FittingDuctName(x):
	FP=x.get_Parameter(BuiltInParameter.RBS_REFERENCE_INSULATION_TYPE).AsString()
	TypeCom = x.Symbol.get_Parameter(BuiltInParameter.ALL_MODEL_TYPE_COMMENTS).AsString()
	if TypeCom:
		ST=TypeCom
	else:
		ST="Врезка из оцинкованной стали"
	
	II=i.index(x.Id)
	listz=[]
	for z in c[II]:
		if z.Shape.ToString() == "Rectangular":
			W = round(z.Width*304.8,0)
			listz.append(W)
			H = round(z.Height*304.8,0)
			listz.append(H)
			MXS = max(W, H)
			MNS = min(W, H)
			w=MXS.ToString()
			h="x" + MNS.ToString()
			SC = w + h
		elif z.Shape.ToString() == "Round":
			D = round(z.Radius*304.8*2,0)
			listz.append(D)
			SC = "Ø" + D.ToString()

		Mx = max(listz)
		Mn = min(listz)
	
	if FP and "EI" in FP:
		if Mx < 2001:
			t = 1.0
		else:
			t = 1.2

	else:
		if Mx < 251:
			t = 0.55
		elif Mx < 1001:
			t = 0.7
		elif Mx < 2001:
			t = 1.0
		else:
			t = 1.2
	
	return ST + " толщиной " + t.ToString() + " мм" + " " + SC


a=FittingDuctName(e[0])
p=[]
for el in e:
	p.append(FittingDuctName(el))
OUT = p, e
# ----------------------------------------
code_block_2 = CodeBlock(a=python_script_4, c=python_script_4) { a[1]; c[0]; }
setParameterByName_2 = Element.SetParameterByName(element=code_block_2.out0, parameterName=string, value=code_block_2.out1)
python_script_5 = Python(IN[0]=python_script_2, IN[1]=python_script)
# ---------- python_script_5.python (73 lines) ----------
import clr
import math
clr.AddReference('ProtoGeometry')
from Autodesk.DesignScript.Geometry import *
clr.AddReference('RevitAPI')
from Autodesk.Revit.DB import *

#Введенные в этом узле данные сохраняется в виде списка в переменных IN.
e = UnwrapElement(IN[0][0])
c = IN[1][1]
i = IN[1][2]

def FittingDuctName(x):
	FP=x.get_Parameter(BuiltInParameter.RBS_REFERENCE_INSULATION_TYPE).AsString()
	TypeCom = x.Symbol.get_Parameter(BuiltInParameter.ALL_MODEL_TYPE_COMMENTS).AsString()
	if TypeCom:
		ST=TypeCom
	else:
		ST="Отвод из оцинкованной стали"
	
	II=i.index(x.Id)
	listz=[]
	if c[II][0].Shape.ToString() == "Rectangular":
		W1 = round(c[II][0].Width*304.8,0)
		listz.append(W1)
		H1 = round(c[II][0].Height*304.8,0)
		listz.append(H1)
		W2 = round(c[II][1].Width*304.8,0)
		listz.append(W2)
		H2 = round(c[II][1].Height*304.8,0)
		listz.append(H2)
		D1 = 2*W1*H1/(W1+H1)
		D2 = 2*W2*H2/(W2+H2)
		if D1>D2:
			SC = W1.ToString() + "x" + H1.ToString() + "/" + W2.ToString() + "x" + H2.ToString()
		elif D1<D2:
			SC = W2.ToString() + "x" + H2.ToString() + "/" + W1.ToString() + "x" + H1.ToString()
		else:
			SC = W1.ToString() + "x" + H1.ToString()
		Al = round(c[II][0].Angle * 57.3 / 15, 0) * 15
	elif c[II][0].Shape.ToString() == "Round":
		D = round(c[II][0].Radius*304.8 * 2, 0)
		listz.append(D)
		SC = "Ø" + D.ToString()
		Al = round(c[II][0].Angle * 57.3 / 15, 0) * 15

	Mx = max(listz)
	Mn = min(listz)
	
	if FP and "EI" in FP:
		if Mx < 2001:
			t = 1.0
		else:
			t = 1.2

	else:
		if Mx < 251:
			t = 0.55
		elif Mx < 1001:
			t = 0.7
		elif Mx < 2001:
			t = 1.0
		else:
			t = 1.2
	
	return ST + " толщиной " + t.ToString() + " мм" + " " + SC + " " + Al.ToString() + "°"


a=FittingDuctName(e[0])
p=[]
for el in e:
	p.append(FittingDuctName(el))
OUT = p, e
# ----------------------------------------
code_block_3 = CodeBlock(a=python_script_5, c=python_script_5) { a[1]; c[0]; }
setParameterByName_3 = Element.SetParameterByName(element=code_block_3.out0, parameterName=string, value=code_block_3.out1)
python_script_6 = Python(IN[0]=python_script_2, IN[1]=python_script)
# ---------- python_script_6.python (90 lines) ----------
import clr
clr.AddReference('ProtoGeometry')
from Autodesk.DesignScript.Geometry import *
clr.AddReference('RevitAPI')
from Autodesk.Revit.DB import *

#Введенные в этом узле данные сохраняется в виде списка в переменных IN.
e = UnwrapElement(IN[0][1])
c = IN[1][1]
i = IN[1][2]

def FittingDuctName(x):
	FP=x.get_Parameter(BuiltInParameter.RBS_REFERENCE_INSULATION_TYPE).AsString()
	TypeCom = x.Symbol.get_Parameter(BuiltInParameter.ALL_MODEL_TYPE_COMMENTS).AsString()
	if TypeCom:
		ST=TypeCom
	else:
		ST="Тройник из оцинкованной стали"
	
	II=i.index(x.Id)
	listz=[]
	SC1=[]
	if c[II][0].Shape.ToString() == "Rectangular":
		W1 = round(c[II][0].Width*304.8,0)
		listz.append(W1)
		H1 = round(c[II][0].Height*304.8,0)
		listz.append(H1)
		W2 = round(c[II][1].Width*304.8,0)
		listz.append(W2)
		H2 = round(c[II][1].Height*304.8,0)
		listz.append(H2)
		W3 = round(c[II][2].Width*304.8,0)
		listz.append(W3)
		H3 = round(c[II][2].Height*304.8,0)
		listz.append(H3)
		Al1 = round(c[II][0].Angle*57.3,0)
		Al2 = round(c[II][1].Angle*57.3,0)
		Al3 = round(c[II][2].Angle*57.3,0)
		if Al1 == 90:
			SC = W2.ToString() + "x" + H2.ToString() + "/" + W1.ToString() + "x" + H1.ToString()
		elif Al2 == 90:
			SC = W1.ToString() + "x" + H1.ToString() + "/" + W2.ToString() + "x" + H2.ToString()
		else:
			SC = W1.ToString() + "x" + H1.ToString() + "/" + W3.ToString() + "x" + H3.ToString()
			
	elif c[II][0].Shape.ToString() == "Round":
		D1 = round(c[II][0].Radius*304.8*2,0)
		listz.append(D1)
		D2 = round(c[II][1].Radius*304.8*2,0)
		listz.append(D2)
		D3 = round(c[II][2].Radius*304.8*2,0)
		listz.append(D3)
		Al1 = round(c[II][0].Angle*57.3,0)
		Al2 = round(c[II][1].Angle*57.3,0)
		Al3 = round(c[II][2].Angle*57.3,0)
		if Al1 == 90:
			SC = "Ø" + D2.ToString() + "/" + "Ø" + D1.ToString()
		elif Al2 == 90:
			SC = "Ø" + D1.ToString() + "/" + "Ø" + D2.ToString()
		else:
			SC = "Ø" + D1.ToString() + "/" + "Ø" + D3.ToString()
			
	Mx = max(listz)
	Mn = min(listz)
	
	if FP and "EI" in FP:
		if Mx < 2001:
			t = 1.0
		else:
			t = 1.2

	else:
		if Mx < 251:
			t = 0.55
		elif Mx < 1001:
			t = 0.7
		elif Mx < 2001:
			t = 1.0
		else:
			t = 1.2
	
	return ST + " толщиной " + t.ToString() + " мм" + " " + SC

p=[]
elements=[]
for el in e:
	p.append(FittingDuctName(el))
	elements.append(el)

OUT = p, elements
# ----------------------------------------
code_block_4 = CodeBlock(a=python_script_6, c=python_script_6) { a[1]; c[0]; }
setParameterByName_4 = Element.SetParameterByName(element=code_block_4.out0, parameterName=string, value=code_block_4.out1)
python_script_7 = Python(IN[0]=python_script_2, IN[1]=python_script)
# ---------- python_script_7.python (103 lines) ----------
import clr
clr.AddReference('ProtoGeometry')
from Autodesk.DesignScript.Geometry import *
clr.AddReference('RevitAPI')
from Autodesk.Revit.DB import *

#Введенные в этом узле данные сохраняется в виде списка в переменных IN.
e = UnwrapElement(IN[0][2])
c = IN[1][1]
i = IN[1][2]

def FittingDuctName(x):
	FP=x.get_Parameter(BuiltInParameter.RBS_REFERENCE_INSULATION_TYPE).AsString()
	TypeCom = x.Symbol.get_Parameter(BuiltInParameter.ALL_MODEL_TYPE_COMMENTS).AsString()
	if TypeCom:
		ST=TypeCom
	else:
		ST="Переход из оцинкованной стали"
	
	II=i.index(x.Id)
	listz=[]
	if c[II][0].Shape.ToString() == "Rectangular" and c[II][1].Shape.ToString() == "Rectangular":
		W1 = round(c[II][0].Width*304.8,0)
		listz.append(W1)
		H1 = round(c[II][0].Height*304.8,0)
		listz.append(H1)
		W2 = round(c[II][1].Width*304.8,0)
		listz.append(W2)
		H2 = round(c[II][1].Height*304.8,0)
		listz.append(H2)
		D1 = 2*W1*H1/(W1+H1)
		D2 = 2*W2*H2/(W2+H2)
		if D1>D2:
			if W1>H1:
				SC = W1.ToString() + "x" + H1.ToString() + "/" + W2.ToString() + "x" + H2.ToString()
			else:
				SC = H1.ToString() + "x" + W1.ToString() + "/" + H2.ToString() + "x" + W2.ToString()
		else:
			if W2>H2:
				SC = W2.ToString() + "x" + H2.ToString() + "/" + W1.ToString() + "x" + H1.ToString()
			else:
				SC = H2.ToString() + "x" + W2.ToString() + "/" + H1.ToString() + "x" + W1.ToString()
	
	elif c[II][0].Shape.ToString() == "Round" and c[II][1].Shape.ToString() == "Round":
		D1 = round(c[II][0].Radius*304.8*2,0)
		listz.append(D1)
		D2 = round(c[II][1].Radius*304.8*2,0)
		listz.append(D2)
		if D1>D2:
			SC = "Ø" + D1.ToString() + "/" + "Ø" + D2.ToString()
		else:
			SC = "Ø" + D2.ToString() + "/" + "Ø" + D1.ToString()
	
	else:
		if c[II][0].Shape.ToString() == "Rectangular":
			W1 = round(c[II][0].Width*304.8,0)
			listz.append(W1)
			H1 = round(c[II][0].Height*304.8,0)
			listz.append(H1)
			MX1 = max(W1, H1)
			MN1 = min(W1, H1)
			D2 = round(c[II][1].Radius*304.8*2,0)
			listz.append(D2)
			SC = MX1.ToString() + "x" + MN1.ToString() + "/" + "Ø" + D2.ToString()
		else:
			W2 = round(c[II][1].Width*304.8,0)
			listz.append(W2)
			H2 = round(c[II][1].Height*304.8,0)
			listz.append(H2)
			MX2 = max(W2, H2)
			MN2 = min(W2, H2)
			D1 = round(c[II][0].Radius*304.8*2,0)
			listz.append(D1)
			SC = MX2.ToString() + "x" + MN2.ToString() + "/" + "Ø" + D1.ToString()
	
		
	Mx = max(listz)
	Mn = min(listz)
	
	if FP and "EI" in FP:
		if Mx < 2001:
			t = 1.0
		else:
			t = 1.2

	else:
		if Mx < 251:
			t = 0.55
		elif Mx < 1001:
			t = 0.7
		elif Mx < 2001:
			t = 1.0
		else:
			t = 1.2
	
	return ST + " толщиной " + t.ToString() + " мм" + " " + SC


a=FittingDuctName(e[0])
p=[]
for el in e:
	p.append(FittingDuctName(el))
OUT = p, e
# ----------------------------------------
code_block_5 = CodeBlock(a=python_script_7, c=python_script_7) { a[1]; c[0]; }
setParameterByName_5 = Element.SetParameterByName(element=code_block_5.out0, parameterName=string, value=code_block_5.out1)
string_2 = StringInput("ADSK_Единица измерения")
string_3 = StringInput("шт.")
unresolved = Rhythm.Revit.Elements.Element.SetParameterByNameTypeOrInstance(element=all_elements_of_category, parameterName=string_2, value=string_3)
string_4 = StringInput("ADSK_Количество")
number = DoubleInput(1)
setParameterByName_6 = Element.SetParameterByName(element=all_elements_of_category, parameterName=string_4, value=number)
