# Dynamo graph 3.3.1_ЭОМиСС_Параметры для элементов узлов.dyn (Dynamo 1.3.2.2480)

categories = Categories("DetailComponents")
all_elements_of_category = ElementsOfCategory(categories)

# group: Копирование парамтера - ДЛИНА
string = StringInput("ADSK_Количество")
string_2 = StringInput("Длина")
getParameterValueByName = Element.GetParameterValueByName(element=all_elements_of_category, parameterName=string_2)

number = DoubleInput(1000)
code_block = CodeBlock(a=getParameterValueByName, b=number) { a/b; }

# group (continued): Копирование парамтера - ДЛИНА
setParameterByName = Element.SetParameterByName(element=all_elements_of_category, parameterName=string, value=code_block)

# group: Копирование парамтера - РАБОЧИЙ НАБОР
string_3 = StringInput("ADSK_Группирование")
workset = Custom[Element.Workset](element=all_elements_of_category)  # Retrieves the workset of a given element
element_name_universal = Custom[Element.Name (Universal)](element=workset)  # Gets an element's name (Dynamo's built-in Name nodes don't work for all element types, e.g. worksets...)
setParameterByName_2 = Element.SetParameterByName(element=all_elements_of_category, parameterName=string_3, value=element_name_universal)

# group: Копирование парамтера - ТИП
string_4 = StringInput("ADSK_Тип")
name = FamilyType.Name(all_elements_of_category)
setParameterByName_3 = Element.SetParameterByName(element=all_elements_of_category, parameterName=string_4, value=name)
