# Dynamo graph 3.3.2_ЭОМиСС_Номер помещения в оборудование.dyn (Dynamo 1.3.2.2480)

categories = Categories("MechanicalEquipment")
all_elements_of_category = ElementsOfCategory(categories)
categories_2 = Categories("Rooms")
all_elements_of_category_2 = ElementsOfCategory(categories_2)
code_block = CodeBlock { "Номер"; }
getParameterValueByName = Element.GetParameterValueByName(element=all_elements_of_category_2, parameterName=code_block)

# group: Запись параметров
code_block_2 = CodeBlock { "ADSK_Номер помещения квартиры"; }
setParameterByName = Element.SetParameterByName(element=all_elements_of_category, parameterName=code_block_2, value=getParameterValueByName)
