# Dynamo graph 3.3.3_ЭОМиСС_Имя панели+Длина лотка.dyn (Dynamo 1.3.2.2480)

categories = Categories("DataDevices")
all_elements_of_category = ElementsOfCategory(categories)
categories_2 = Categories("GenericModel")
all_elements_of_category_2 = ElementsOfCategory(categories_2)
categories_3 = Categories("LightingDevices")
all_elements_of_category_3 = ElementsOfCategory(categories_3)
categories_4 = Categories("LightingFixtures")
all_elements_of_category_4 = ElementsOfCategory(categories_4)
categories_5 = Categories("SecurityDevices")
all_elements_of_category_5 = ElementsOfCategory(categories_5)
categories_6 = Categories("Assemblies")
all_elements_of_category_6 = ElementsOfCategory(categories_6)
categories_7 = Categories("ElectricalFixtures")
all_elements_of_category_7 = ElementsOfCategory(categories_7)
categories_8 = Categories("FireAlarmDevices")
all_elements_of_category_8 = ElementsOfCategory(categories_8)
categories_9 = Categories("TelephoneDevices")
all_elements_of_category_9 = ElementsOfCategory(categories_9)
categories_10 = Categories("NurseCallDevices")
all_elements_of_category_10 = ElementsOfCategory(categories_10)
categories_11 = Categories("CommunicationDevices")
all_elements_of_category_11 = ElementsOfCategory(categories_11)
categories_12 = Categories("ElectricalCircuit")
all_elements_of_category_12 = ElementsOfCategory(categories_12)
join = List.Join(all_elements_of_category, all_elements_of_category_2, all_elements_of_category_3, all_elements_of_category_4, all_elements_of_category_5, all_elements_of_category_6, all_elements_of_category_7, all_elements_of_category_8, all_elements_of_category_9, all_elements_of_category_10, all_elements_of_category_11, all_elements_of_category_12)
code_block = CodeBlock { "ПР_Группирование ЭОМ"; }
code_block_2 = CodeBlock { "Панель"; }
getParameterValueByName = Element.GetParameterValueByName(element=join, parameterName=code_block_2)
setParameterByName = Element.SetParameterByName(element=join, parameterName=code_block, value=getParameterValueByName)
categories_13 = Categories("ElectricalEquipment")
all_elements_of_category_13 = ElementsOfCategory(categories_13)
code_block_3 = CodeBlock { "ПР_Группирование ЭОМ"; }
code_block_4 = CodeBlock { "Имя панели"; }
getParameterValueByName_2 = Element.GetParameterValueByName(element=all_elements_of_category_13, parameterName=code_block_4)
setParameterByName_2 = Element.SetParameterByName(element=all_elements_of_category_13, parameterName=code_block_3, value=getParameterValueByName_2)
categories_14 = Categories("CableTray")
all_elements_of_category_14 = ElementsOfCategory(categories_14)
code_block_5 = CodeBlock { "ADSK_Количество"; }
code_block_6 = CodeBlock { "Длина"; }
getParameterValueByName_3 = Element.GetParameterValueByName(element=all_elements_of_category_14, parameterName=code_block_6)
запас = DoubleSlider(1.1, range=1..2 step 0.1)
code_block_7 = CodeBlock(a=getParameterValueByName_3, b=запас) { a/1000*b; }
setParameterByName_3 = Element.SetParameterByName(element=all_elements_of_category_14, parameterName=code_block_5, value=code_block_7)
categories_15 = Categories("CableTrayFitting")
all_elements_of_category_15 = ElementsOfCategory(categories_15)
code_block_8 = CodeBlock { "ADSK_Количество"; }
number_slider = DoubleSlider(1, range=0..100 step 0.1)
setParameterByName_4 = Element.SetParameterByName(element=all_elements_of_category_15, parameterName=code_block_8, value=number_slider)
