# Dynamo graph 3.3.4_ЭОМиСС_Нумерация по цепи.dyn (Dynamo 1.3.2.2480)

boolean = BoolSelector(false)
springs_selectelements_ordered = Custom[Springs.SelectElements(ordered)](refresh=boolean)  # Select multiple elements from the Revit document in the desired order. Hit ESC to stop picking. To refresh the node, connect a boolean switch node.
параметр_вывода = StringInput("Комментарии")
префикс = StringInput("LOL 1.")
нумеровать_с = DoubleInput(1)
count = Count(springs_selectelements_ordered)
sequence = Sequence(start=нумеровать_с, amount=count, lacing=Longest)
string_from_object = FromObject(sequence)
add = префикс + string_from_object
setParameterByName = Element.SetParameterByName(element=springs_selectelements_ordered, parameterName=параметр_вывода, value=add)
