# Dynamo graph 3.3.5_ЭОМ_Сведения о светильниках (Пространства).dyn (Dynamo 1.3.4.6666)

имя_параметра_с_количеством = StringInput("LT_Количество в помещении")  # "Имя параметра с количеством светильников в помещении"
имя_параметра_с_высотой = StringInput("LT_Высота установки")  # "Имя параметра с высотой установки"
levels = Levels()
categories = Categories("LightingFixtures")
all_elements_of_category = ElementsOfCategory(categories)
categories_2 = Categories("MEPSpaces")
all_elements_of_category_2 = ElementsOfCategory(categories_2)
имя_параметра_с_заданной = StringInput("LT_Освещенность заданная")  # "Имя параметра с заданной освещенностью"
parameterByName = Parameter.ParameterByName(element=all_elements_of_category_2, name=имя_параметра_с_заданной)
watch = Watch(parameterByName)
set_installation_height_and = Custom[Set Installation Height and Quantity in Room to LF]()  # Данный узел записывает в свойства светильника высоту установки и количество светильников в помещении согласно ГОСТ 21.608-2014; unwired: quantityParameterName, heigthParameterName, referenceLevel
обновить = BoolSelector(false)
setParameterByName = Custom[SetParameterByName](refresh=обновить)  # unwired: elements, parameterName, value
имя_параметра_с_заданной_2 = StringInput("LT_Освещенность заданная")  # "Имя параметра с заданной освещенностью"
