# Dynamo graph 3.3.5_ЭОМ_Сведения о светильниках (помещения в файле электрики).dyn (Dynamo 1.3.4.6666)

имя_параметра_с_количеством = StringInput("LT_Количество в помещении")  # "Имя параметра с количеством светильников в помещении"
имя_параметра_с_высотой = StringInput("LT_Высота установки")  # "Имя параметра с высотой установки"
levels = Levels("Паркинг_План на отм. -3.650")
обновить = BoolSelector(false)
set_installation_height_and = Custom[Set Installation Height and Quantity in Room to LF](quantityParameterName=имя_параметра_с_количеством, heigthParameterName=имя_параметра_с_высотой, referenceLevel=levels, refresh=обновить)  # Данный узел записывает в свойства светильника высоту установки и количество светильников в помещении согласно ГОСТ 21.608-2014
watch = Watch(set_installation_height_and)
