# Dynamo graph 3.3.5_ЭОМ_Сведения о светильниках (помещения из связанного файла).dyn (Dynamo 1.3.4.6666)

имя_связанного_файла_с = StringInput("07-00-РД-АР-31-СКЮГ7_publication.rvt")  # "Имя связанного файла с помещениями"
имя_параметра_с_количеством = StringInput("LT_Количество в помещении")  # "Имя параметра с количеством светильников в помещении"
имя_параметра_с_высотой = StringInput("LT_Высота установки")  # "Имя параметра с высотой установки"
уровень = Levels("Паркинг_План на отм. -3.650")
обновить = BoolSelector(true)
set_installation_height_and = Custom[Set Installation Height and Quantity in Room (from link) to LF](revitLinkName=имя_связанного_файла_с, quantityParameterName=имя_параметра_с_количеством, heigthParameterName=имя_параметра_с_высотой, referenceLevel=уровень, refresh=обновить)  # Данный узел записывает в свойства светильников высоту установки и количество светильников в помещении для маркировки согласно ГОСТ 21.608-2014
watch = Watch(set_installation_height_and)
