# Dynamo graph 02_Отверстия_Отметка.dyn (Dynamo 1.3.2.2480)

# group: Проверяем есть ли параметр УРОВЕНЬ
categories = Categories("GenericModel")
all_elements_of_category = ElementsOfCategory(categories)
string = StringInput("Уровень")
getParameterValueByName = Element.GetParameterValueByName(element=all_elements_of_category, parameterName=string)
code_block = CodeBlock { ""; }
eq = getParameterValueByName == code_block
filterByBoolMask = List.FilterByBoolMask(list=all_elements_of_category, mask=eq)

# group: Если нету берем параметр ОСНОВА
string_2 = StringInput("ADSK_Этаж")
string_3 = StringInput("Основа")
getParameterValueByName_2 = Element.GetParameterValueByName(element=filterByBoolMask.in, parameterName=string_3)
string_from_object = FromObject(getParameterValueByName_2)
code_block_2 = CodeBlock { ": "; }
split = String.Split(string_from_object, code_block_2)
transpose = List.Transpose(split)
code_block_3 = CodeBlock(N=transpose) { N[1]; }
getLevelByName = archilab.Revit.Selection.Select.GetLevelByName(code_block_3)
name = Level.Name(getLevelByName)
setParameterByName = Element.SetParameterByName(element=filterByBoolMask.in, parameterName=string_2, value=name)
string_4 = StringInput("ADSK_Отверстие_Отметка этажа")
elevation = Level.Elevation(getLevelByName)
setParameterByName_2 = Element.SetParameterByName(element=filterByBoolMask.in, parameterName=string_4, value=elevation)

# group: Если есть берем параметр УРОВЕНЬ
string_5 = StringInput("ADSK_Этаж")
string_6 = StringInput("Уровень")
getParameterValueByName_3 = Element.GetParameterValueByName(element=filterByBoolMask.out, parameterName=string_6)
name_2 = Level.Name(getParameterValueByName_3)
setParameterByName_3 = Element.SetParameterByName(element=filterByBoolMask.out, parameterName=string_5, value=name_2)
string_7 = StringInput("ADSK_Отверстие_Отметка этажа")
elevation_2 = Level.Elevation(getParameterValueByName_3)
setParameterByName_4 = Element.SetParameterByName(element=filterByBoolMask.out, parameterName=string_7, value=elevation_2)

# group: ADSK_Отверстие_Отметка от этажа если есть параметр УРОВЕНЬ
string_8 = StringInput("ADSK_Отверстие_Отметка от этажа")
string_9 = StringInput("Смещение")
getParameterValueByName_4 = Element.GetParameterValueByName(element=filterByBoolMask.out, parameterName=string_9)
setParameterByName_5 = Element.SetParameterByName(element=filterByBoolMask.out, parameterName=string_8, value=getParameterValueByName_4)

# group: ADSK_Отверстие_Отметка от этажа если параметр ОСНОВА
string_10 = StringInput("ADSK_Отверстие_Отметка от этажа")
string_11 = StringInput("Смещение")
getParameterValueByName_5 = Element.GetParameterValueByName(element=filterByBoolMask.in, parameterName=string_11)
code_block_4 = CodeBlock(a=getParameterValueByName_5, b=elevation) { a-b; }
setParameterByName_6 = Element.SetParameterByName(element=filterByBoolMask.in, parameterName=string_10, value=code_block_4)

# group: Фильтруем Вертикальные и Горизонтальные заглушки
string_12 = StringInput("Описание")
getParameterValueByNameTypeOrInstance = Rhythm.Revit.Elements.Element.GetParameterValueByNameTypeOrInstance(filterByBoolMask.in, string_12)  # frozen
code_block_5 = CodeBlock { "Вертикальные конструкции"; }
eq_2 = getParameterValueByNameTypeOrInstance == code_block_5
filterByBoolMask_2 = List.FilterByBoolMask(list=filterByBoolMask.in, mask=eq_2)
