# Dynamo graph 03_Отверстия_Нумерация.dyn (Dynamo 2.0.2.6826)

# group: Выбираем этаж и категорию
categories = Categories(index=372)
all_elements_of_category = ElementsOfCategory(Category=categories)
code_block = CodeBlock { "ADSK_Этаж"; }
getParameterValueByName = Element.GetParameterValueByName(element=all_elements_of_category, parameterName=code_block)
уровень = Levels(index=0)  # graph input
name = Level.Name(level=уровень)
eq = getParameterValueByName == name
filterByBoolMask = List.FilterByBoolMask(list=all_elements_of_category, mask=eq)

параметр = StringInput("ADSK_Штамп Раздел проекта")  # graph input

# group: Группируем по 1 параметру (Раздел проекта)
get_type_parameter = Custom[Get Type Parameter](element=filterByBoolMask.in, parameterName=параметр)  # This node will retrieve a type parameter by its name.
code_block_2 = CodeBlock { "ОВ.О"; "ОВ.В"; "ВК"; "ЭОМ"; }
eq_2 = get_type_parameter == code_block_2.out0
filterByBoolMask_2 = List.FilterByBoolMask(list=filterByBoolMask.in, mask=eq_2)
code_block_3 = CodeBlock { "ADSK_Штамп Раздел проекта"; }
eq_3 = get_type_parameter == code_block_2.out1
filterByBoolMask_3 = List.FilterByBoolMask(list=filterByBoolMask.in, mask=eq_3)
eq_4 = get_type_parameter == code_block_2.out2
filterByBoolMask_4 = List.FilterByBoolMask(list=filterByBoolMask.in, mask=eq_4)
eq_5 = get_type_parameter == code_block_2.out3
filterByBoolMask_5 = List.FilterByBoolMask(list=filterByBoolMask.in, mask=eq_5)

# group: Группируем по 2 параметру (Группирование)
code_block_4 = CodeBlock { "ADSK_Группирование"; }
getParameterValueByName_2 = Element.GetParameterValueByName(element=filterByBoolMask_2.in, parameterName=code_block_4)
code_block_5 = CodeBlock { "ГКЛ"; "Кирпич"; "Монолит"; }
eq_6 = getParameterValueByName_2 == code_block_5.out0
filterByBoolMask_6 = List.FilterByBoolMask(list=filterByBoolMask_2.in, mask=eq_6)
string = StringInput("ADSK_Позиция")
code_block_6 = CodeBlock { 1; }
count = List.Count(list=filterByBoolMask_6.in)
sequence = Sequence(start=code_block_6, amount=count, step=code_block_6, lacing=Longest)
string_from_object = FromObject(obj=sequence)
setParameterByName = Element.SetParameterByName(element=filterByBoolMask_6.in, parameterName=string, value=string_from_object)
code_block_7 = CodeBlock { "ADSK_Группирование"; }
getParameterValueByName_3 = Element.GetParameterValueByName(element=filterByBoolMask_2.in, parameterName=code_block_7)
code_block_8 = CodeBlock { "ГКЛ"; "Кирпич"; "Монолит"; }
eq_7 = getParameterValueByName_3 == code_block_8.out1
filterByBoolMask_7 = List.FilterByBoolMask(list=filterByBoolMask_2.in, mask=eq_7)
string_2 = StringInput("ADSK_Позиция")
code_block_9 = CodeBlock { 1; }
count_2 = List.Count(list=filterByBoolMask_7.in)
sequence_2 = Sequence(start=code_block_9, amount=count_2, step=code_block_9, lacing=Longest)
string_from_object_2 = FromObject(obj=sequence_2)
setParameterByName_2 = Element.SetParameterByName(element=filterByBoolMask_7.in, parameterName=string_2, value=string_from_object_2)
code_block_10 = CodeBlock { "ADSK_Группирование"; }
getParameterValueByName_4 = Element.GetParameterValueByName(element=filterByBoolMask_2.in, parameterName=code_block_10)
code_block_11 = CodeBlock { "ГКЛ"; "Кирпич"; "Монолит"; }
eq_8 = getParameterValueByName_4 == code_block_11.out2
filterByBoolMask_8 = List.FilterByBoolMask(list=filterByBoolMask_2.in, mask=eq_8)
string_3 = StringInput("ADSK_Позиция")
code_block_12 = CodeBlock { 1; }
count_3 = List.Count(list=filterByBoolMask_8.in)
sequence_3 = Sequence(start=code_block_12, amount=count_3, step=code_block_12, lacing=Longest)
string_from_object_3 = FromObject(obj=sequence_3)
setParameterByName_3 = Element.SetParameterByName(element=filterByBoolMask_8.in, parameterName=string_3, value=string_from_object_3)

# group: Группируем по 2 параметру (Группирование)
code_block_13 = CodeBlock { "ADSK_Группирование"; }
getParameterValueByName_5 = Element.GetParameterValueByName(element=filterByBoolMask_3.in, parameterName=code_block_13)
code_block_14 = CodeBlock { "ГКЛ"; "Кирпич"; "Монолит"; }
eq_9 = getParameterValueByName_5 == code_block_14.out0
filterByBoolMask_9 = List.FilterByBoolMask(list=filterByBoolMask_3.in, mask=eq_9)
string_4 = StringInput("ADSK_Позиция")
code_block_15 = CodeBlock { 1; }
count_4 = List.Count(list=filterByBoolMask_9.in)
sequence_4 = Sequence(start=code_block_15, amount=count_4, step=code_block_15, lacing=Longest)
string_from_object_4 = FromObject(obj=sequence_4)
setParameterByName_4 = Element.SetParameterByName(element=filterByBoolMask_9.in, parameterName=string_4, value=string_from_object_4)
code_block_16 = CodeBlock { "ADSK_Группирование"; }
getParameterValueByName_6 = Element.GetParameterValueByName(element=filterByBoolMask_3.in, parameterName=code_block_16)
code_block_17 = CodeBlock { "ГКЛ"; "Кирпич"; "Монолит"; }
eq_10 = getParameterValueByName_6 == code_block_17.out1
filterByBoolMask_10 = List.FilterByBoolMask(list=filterByBoolMask_3.in, mask=eq_10)
string_5 = StringInput("ADSK_Позиция")
code_block_18 = CodeBlock { 1; }
count_5 = List.Count(list=filterByBoolMask_10.in)
sequence_5 = Sequence(start=code_block_18, amount=count_5, step=code_block_18, lacing=Longest)
string_from_object_5 = FromObject(obj=sequence_5)
setParameterByName_5 = Element.SetParameterByName(element=filterByBoolMask_10.in, parameterName=string_5, value=string_from_object_5)
code_block_19 = CodeBlock { "ADSK_Группирование"; }
getParameterValueByName_7 = Element.GetParameterValueByName(element=filterByBoolMask_3.in, parameterName=code_block_19)
code_block_20 = CodeBlock { "ГКЛ"; "Кирпич"; "Монолит"; }
eq_11 = getParameterValueByName_7 == code_block_20.out2
filterByBoolMask_11 = List.FilterByBoolMask(list=filterByBoolMask_3.in, mask=eq_11)
string_6 = StringInput("ADSK_Позиция")
code_block_21 = CodeBlock { 1; }
count_6 = List.Count(list=filterByBoolMask_11.in)
sequence_6 = Sequence(start=code_block_21, amount=count_6, step=code_block_21, lacing=Longest)
string_from_object_6 = FromObject(obj=sequence_6)
setParameterByName_6 = Element.SetParameterByName(element=filterByBoolMask_11.in, parameterName=string_6, value=string_from_object_6)

# group: Группируем по 2 параметру (Группирование)
code_block_22 = CodeBlock { "ADSK_Группирование"; }
getParameterValueByName_8 = Element.GetParameterValueByName(element=filterByBoolMask_4.in, parameterName=code_block_22)
code_block_23 = CodeBlock { "ГКЛ"; "Кирпич"; "Монолит"; }
eq_12 = getParameterValueByName_8 == code_block_23.out0
filterByBoolMask_12 = List.FilterByBoolMask(list=filterByBoolMask_4.in, mask=eq_12)
string_7 = StringInput("ADSK_Позиция")
code_block_24 = CodeBlock { 1; }
count_7 = List.Count(list=filterByBoolMask_12.in)
sequence_7 = Sequence(start=code_block_24, amount=count_7, step=code_block_24, lacing=Longest)
string_from_object_7 = FromObject(obj=sequence_7)
setParameterByName_7 = Element.SetParameterByName(element=filterByBoolMask_12.in, parameterName=string_7, value=string_from_object_7)
code_block_25 = CodeBlock { "ADSK_Группирование"; }
getParameterValueByName_9 = Element.GetParameterValueByName(element=filterByBoolMask_4.in, parameterName=code_block_25)
code_block_26 = CodeBlock { "ГКЛ"; "Кирпич"; "Монолит"; }
eq_13 = getParameterValueByName_9 == code_block_26.out1
filterByBoolMask_13 = List.FilterByBoolMask(list=filterByBoolMask_4.in, mask=eq_13)
string_8 = StringInput("ADSK_Позиция")
code_block_27 = CodeBlock { 1; }
count_8 = List.Count(list=filterByBoolMask_13.in)
sequence_8 = Sequence(start=code_block_27, amount=count_8, step=code_block_27, lacing=Longest)
string_from_object_8 = FromObject(obj=sequence_8)
setParameterByName_8 = Element.SetParameterByName(element=filterByBoolMask_13.in, parameterName=string_8, value=string_from_object_8)
code_block_28 = CodeBlock { "ADSK_Группирование"; }
getParameterValueByName_10 = Element.GetParameterValueByName(element=filterByBoolMask_4.in, parameterName=code_block_28)
code_block_29 = CodeBlock { "ГКЛ"; "Кирпич"; "Монолит"; }
eq_14 = getParameterValueByName_10 == code_block_29.out2
filterByBoolMask_14 = List.FilterByBoolMask(list=filterByBoolMask_4.in, mask=eq_14)
string_9 = StringInput("ADSK_Позиция")
code_block_30 = CodeBlock { 1; }
count_9 = List.Count(list=filterByBoolMask_14.in)
sequence_9 = Sequence(start=code_block_30, amount=count_9, step=code_block_30, lacing=Longest)
string_from_object_9 = FromObject(obj=sequence_9)
setParameterByName_9 = Element.SetParameterByName(element=filterByBoolMask_14.in, parameterName=string_9, value=string_from_object_9)

# group: Группируем по 2 параметру (Группирование)
code_block_31 = CodeBlock { "ADSK_Группирование"; }
getParameterValueByName_11 = Element.GetParameterValueByName(element=filterByBoolMask_5.in, parameterName=code_block_31)
code_block_32 = CodeBlock { "ГКЛ"; "Кирпич"; "Монолит"; }
eq_15 = getParameterValueByName_11 == code_block_32.out0
filterByBoolMask_15 = List.FilterByBoolMask(list=filterByBoolMask_5.in, mask=eq_15)
string_10 = StringInput("ADSK_Позиция")
code_block_33 = CodeBlock { 1; }
count_10 = List.Count(list=filterByBoolMask_15.in)
sequence_10 = Sequence(start=code_block_33, amount=count_10, step=code_block_33, lacing=Longest)
string_from_object_10 = FromObject(obj=sequence_10)
setParameterByName_10 = Element.SetParameterByName(element=filterByBoolMask_15.in, parameterName=string_10, value=string_from_object_10)
code_block_34 = CodeBlock { "ADSK_Группирование"; }
getParameterValueByName_12 = Element.GetParameterValueByName(element=filterByBoolMask_5.in, parameterName=code_block_34)
code_block_35 = CodeBlock { "ГКЛ"; "Кирпич"; "Монолит"; }
eq_16 = getParameterValueByName_12 == code_block_35.out1
filterByBoolMask_16 = List.FilterByBoolMask(list=filterByBoolMask_5.in, mask=eq_16)
string_11 = StringInput("ADSK_Позиция")
code_block_36 = CodeBlock { 1; }
count_11 = List.Count(list=filterByBoolMask_16.in)
sequence_11 = Sequence(start=code_block_36, amount=count_11, step=code_block_36, lacing=Longest)
string_from_object_11 = FromObject(obj=sequence_11)
setParameterByName_11 = Element.SetParameterByName(element=filterByBoolMask_16.in, parameterName=string_11, value=string_from_object_11)
code_block_37 = CodeBlock { "ADSK_Группирование"; }
getParameterValueByName_13 = Element.GetParameterValueByName(element=filterByBoolMask_5.in, parameterName=code_block_37)
code_block_38 = CodeBlock { "ГКЛ"; "Кирпич"; "Монолит"; }
eq_17 = getParameterValueByName_13 == code_block_38.out2
filterByBoolMask_17 = List.FilterByBoolMask(list=filterByBoolMask_5.in, mask=eq_17)
string_12 = StringInput("ADSK_Позиция")
code_block_39 = CodeBlock { 1; }
count_12 = List.Count(list=filterByBoolMask_17.in)
sequence_12 = Sequence(start=code_block_39, amount=count_12, step=code_block_39, lacing=Longest)
string_from_object_12 = FromObject(obj=sequence_12)
setParameterByName_12 = Element.SetParameterByName(element=filterByBoolMask_17.in, parameterName=string_12, value=string_from_object_12)

code_block_40 = CodeBlock { "Раздел проекта"; }

# group: Если ADSK_Группирование не заполненно
code_block_41 = CodeBlock { "ADSK_Группирование"; }
getParameterValueByName_14 = Element.GetParameterValueByName(element=filterByBoolMask.in, parameterName=code_block_41)
code_block_42 = CodeBlock { "0"; }
eq_18 = getParameterValueByName_14 == code_block_42
filterByBoolMask_18 = List.FilterByBoolMask(list=getParameterValueByName_14, mask=eq_18)
string_13 = StringInput("ADSK_Позиция")
string_14 = StringInput("Группирование!")
setParameterByName_13 = Element.SetParameterByName(element=filterByBoolMask_18.in, parameterName=string_13, value=string_14)
