# Dynamo graph 05_Отверстия_Вырезать.dyn (Dynamo 2.0.2.6826)

# group: Выбираем этаж
уровень = Levels(index=0)  # graph input
all_elements_at_level = ElementsAtLevel(Level=уровень)

# group: Выбираем категорию для перегородок
categories = Categories(index=525)
code_block = CodeBlock { "Contains"; }
ʳʰʸᵗʰᵐ_elementfilter_bycategory = Rhythm.Revit.ElementFilter.ElementFilter.ByCategory(elements=all_elements_at_level, category=categories, filterMethod=code_block)

# group: Фильтр дыр для стен
categories_2 = Categories(index=372)
all_elements_of_category = ElementsOfCategory(Category=categories_2)
getFamily = FamilyInstance.GetFamily(familyInstance=all_elements_of_category)
name = Family.Name(family=getFamily)
string = StringInput("Стены")
contains = String.Contains(str=name, searchFor=string)
filterByBoolMask = List.FilterByBoolMask(list=all_elements_of_category, mask=contains)

# group: Вырезать отверстия
code_block_2 = CodeBlock { ".001"; }
getSurroundingElements = Custom[Tool.GetSurroundingElements](Element=ʳʰʸᵗʰᵐ_elementfilter_bycategory, ElementCheck=filterByBoolMask.in, Tolerance=code_block_2)  # Get Surrounding Elements by Categories, group them as List. Tolerance distance available.
addVoidCut = Custom[Tool.AddVoidCut](ListOfList=getSurroundingElements)  # Add void cut for a Set of elements. In combination with Get surrounding elements node.
watch = Watch(addVoidCut)

# group: Вырезать отверстия
code_block_3 = CodeBlock { ".001"; }
getSurroundingElements_2 = Custom[Tool.GetSurroundingElements](Element=ʳʰʸᵗʰᵐ_elementfilter_bycategory, ElementCheck=filterByBoolMask.in, Tolerance=code_block_3)
addVoidCut_2 = Custom[Tool.AddVoidCut](ListOfList=getSurroundingElements_2)
watch_2 = Watch(addVoidCut_2)

# group: Выбираем категорию для перегородок
categories_3 = Categories(index=435)
code_block_4 = CodeBlock { "Contains"; }
ʳʰʸᵗʰᵐ_elementfilter_bycategory_2 = Rhythm.Revit.ElementFilter.ElementFilter.ByCategory(elements=all_elements_at_level, category=categories_3, filterMethod=code_block_4)

# group: Фильтр дыр для стен
categories_4 = Categories(index=372)
all_elements_of_category_2 = ElementsOfCategory(Category=categories_4)
getFamily_2 = FamilyInstance.GetFamily(familyInstance=all_elements_of_category_2)
name_2 = Family.Name(family=getFamily_2)
string_2 = StringInput("Перекрытия")
contains_2 = String.Contains(str=name_2, searchFor=string_2)
filterByBoolMask_2 = List.FilterByBoolMask(list=all_elements_of_category_2, mask=contains_2)

# group: Вырезать отверстия
code_block_5 = CodeBlock { ".001"; }
getSurroundingElements_3 = Custom[Tool.GetSurroundingElements](Element=ʳʰʸᵗʰᵐ_elementfilter_bycategory_2, ElementCheck=filterByBoolMask_2.in, Tolerance=code_block_5)
addVoidCut_3 = Custom[Tool.AddVoidCut](ListOfList=getSurroundingElements_3)
watch_3 = Watch(addVoidCut_3)

# group: Вырезать отверстия
code_block_6 = CodeBlock { ".001"; }
getSurroundingElements_4 = Custom[Tool.GetSurroundingElements](Element=ʳʰʸᵗʰᵐ_elementfilter_bycategory_2, ElementCheck=filterByBoolMask_2.in, Tolerance=code_block_6)
addVoidCut_4 = Custom[Tool.AddVoidCut](ListOfList=getSurroundingElements_4)
watch_4 = Watch(addVoidCut_4)
