# Dynamo graph 05_Отверстия_Вырезать_Перекрытия.dyn (Dynamo 1.3.2.2480)

# group: Выбираем этаж
уровень = Levels("Этаж 01")
all_elements_at_level = ElementsAtLevel(уровень)

# group: Выбираем категорию для перегородок
категория = StringInput("Перекрытия")
byName = Category.ByName(категория)
all_elements_of_category = ElementsOfCategory(byName)
isOfCategory = Custom[Element.IsOfCategory](element=all_elements_at_level, category=byName)  # Checks whether an element is of a specified category
filterByBoolMask = List.FilterByBoolMask(list=all_elements_at_level, mask=isOfCategory)

# group: Выбираем категорию для отверстий
categories = Categories("GenericModel")
all_elements_of_category_2 = ElementsOfCategory(categories)
isOfCategory_2 = Custom[Element.IsOfCategory](category=categories)  # unwired: element
filterByBoolMask_2 = List.FilterByBoolMask(list=all_elements_at_level, mask=isOfCategory_2)

# group: Вырезать отверстия
categories_2 = Categories("Walls")
code_block = CodeBlock { ".001"; }
getSurroundingElements = Custom[Tool.GetSurroundingElements](Element=all_elements_of_category, ElementCheck=all_elements_of_category_2, Tolerance=code_block)  # Get Surrounding Elements by Categories, group them as List. Tolerance distance available.
addVoidCut = Custom[Tool.AddVoidCut](ListOfList=getSurroundingElements)  # Add void cut for a Set of elements. In combination with Get surrounding elements node.
watch = Watch(addVoidCut)
