# Dynamo graph 05_Отверстия_Вырезать_Стены.dyn (Dynamo 1.3.4.6666)

# group: Выбираем этаж
уровень = Levels("Этаж 26")
all_elements_at_level = ElementsAtLevel(уровень)

# group: Выбираем категорию для перегородок
категория = StringInput("Стены")
byName = Category.ByName(категория)
isOfCategory = Custom[Element.IsOfCategory](element=all_elements_at_level, category=byName)  # Checks whether an element is of a specified category
filterByBoolMask = List.FilterByBoolMask(list=all_elements_at_level, mask=isOfCategory)
all_elements_of_category = ElementsOfCategory(byName)

string = StringInput("Задание_Отверстие_Стены_Пр")
byName_2 = Family.ByName(string)
types = Family.Types(byName_2)
all_elements_of_family_type = ElementsOfFamilyType(types)

# group: Вырезать отверстия
code_block = CodeBlock { ".001"; }
getSurroundingElements = Custom[Tool.GetSurroundingElements](Element=filterByBoolMask.in, ElementCheck=all_elements_of_family_type, Tolerance=code_block)  # Get Surrounding Elements by Categories, group them as List. Tolerance distance available.
addVoidCut = Custom[Tool.AddVoidCut](ListOfList=getSurroundingElements)  # Add void cut for a Set of elements. In combination with Get surrounding elements node.
watch = Watch(addVoidCut)

string_2 = StringInput("Задание_Отверстие_Стены_Кр")
byName_3 = Family.ByName(string_2)
types_2 = Family.Types(byName_3)
all_elements_of_family_type_2 = ElementsOfFamilyType(types_2)

# group: Вырезать отверстия
code_block_2 = CodeBlock { ".001"; }
getSurroundingElements_2 = Custom[Tool.GetSurroundingElements](Element=filterByBoolMask.in, ElementCheck=all_elements_of_family_type_2, Tolerance=code_block_2)
addVoidCut_2 = Custom[Tool.AddVoidCut](ListOfList=getSurroundingElements_2)
watch_2 = Watch(addVoidCut_2)
