# Dynamo graph 101_Спецификация_Экспорт.dyn (Dynamo 2.0.2.6826)

element_types = ElementTypes(index=336)
all_elements_of_type = ElementsOfType(element_type=element_types)
name = Element.Name(element=all_elements_of_type)

# group: INPUT
префикс_для_экспорт_спецификаций = StringInput("О_")  # graph input
папка_для_сохранения = Directory("C:\Temp")  # graph input
boolean = BoolSelector(true)  # graph input

boolean_2 = BoolSelector(false)
startsWith = String.StartsWith(str=name, searchFor=префикс_для_экспорт_спецификаций, ignoreCase=boolean_2)
filterByBoolMask = List.FilterByBoolMask(list=all_elements_of_type, mask=startsWith)

# group: Format
string = StringInput(".txt")  # graph input

# group: NameConfig
string_2 = StringInput("\")
name_2 = Element.Name(element=filterByBoolMask.in)
code_block = CodeBlock(FilePut=папка_для_сохранения, append1=string_2, append2=name_2, extension=string) { FilePut + append1 + append2 + extension; }

export_column_headers = ExportColumnHeaders(index=0)
boolean_3 = BoolSelector(true)
byProperties = Revit.Schedules.ScheduleExportOptions.ByProperties(columnHeaders=export_column_headers, headersFootersBlanks=boolean_3, title=boolean)
export = ScheduleView.Export(scheduleView=filterByBoolMask.in, path=code_block, exportOptions=byProperties)
watch = Watch(export)
