# Dynamo graph 102_Спецификация_Добавить1Столбец_Папка.dyn (Dynamo 2.0.2.6826)

папка_с_файлами = Directory("C:\Temp\Test")  # graph input
watch = Watch(папка_с_файлами)
string = StringInput("""from System.IO import Directory
import re
import time
import sys
sys.path.append('C:\Program Files (x86)\IronPython 2.7\Lib')
import subprocess
import os
import errno
import csv
import clr
clr.AddReferenceByName('Microsoft.Office.Interop.Excel, Version=11.0.0.0, Culture=neutral, PublicKeyToken=71e9bce111e9429c')
from Microsoft.Office.Interop import Excel
from Microsoft.Office.Interop.Excel import ApplicationClass
from System.Runtime.InteropServices import Marshal

true_false = IN[0]

def excel_close(_bool):
    if _bool: 
        xlApp = Marshal.GetActiveObject("Excel.Application")	
        xlApp.Visible = True
        xlApp.DisplayAlerts = False
        xlApp.Workbooks.Close()
        xlApp.Quit()
        Check =  "Success"
    else:
        Check = "Set the boolean to True"

    return Check

OUT = excel_close(true_false)""")
закрыть_окна = BoolSelector(true)
directory_from_path = DirectoryObject(path=папка_с_файлами)
boolean = BoolSelector(false)
getDirectoryContents = FileSystem.GetDirectoryContents(directory=directory_from_path, includeSubdirectories=boolean)
string_from_object = FromObject(obj=getDirectoryContents.files)
fileName = FileSystem.FileName(path=getDirectoryContents.files, withExtension=boolean)
code_block = CodeBlock { 0; }
file_from_path = FileObject(path=getDirectoryContents.files)
code_block_2 = CodeBlock { 1; }
chop = List.Chop(list=file_from_path, lengths=code_block_2)
importExcel = Data.ImportExcel(file=chop, sheetName=fileName)
count = List.Count(list=importExcel@L3)
cycle = List.Cycle(list=fileName@L1, amount=count@@L1)
transpose = List.Transpose(lists=cycle@L1)
chop_2 = List.Chop(list=transpose, lengths=count)
end = Revit.Transaction.Transaction.End(input=chop_2)
exportExcel = Data.ExportExcel(filePath=string_from_object, sheetName=fileName, startRow=code_block, startCol=code_block, data=end)  # frozen
start = Revit.Transaction.Transaction.Start(input=exportExcel)
python_script_from_string = PythonStringNode(script=string, IN[0]=закрыть_окна, IN[1]=start)
